# Grasshopper definition 210615_contextdecoder-analysis only essential.gh (Grasshopper 1.0.7)

# ---- group: RH_IN:OpenAnalysis
number_slider = Slider(0, range=0..1)

# ---- group: RH_IN:Radius
radius = Slider(0, range=0..2)

# ----
boolean_toggle = BooleanToggle(False)
rh_in = Point(Point(6091.779221, 8470.964292, -439.6298339))
get_point = GetPoint(rh_in, AtLeast=1, AtMost=2147483647, Realtime=True)
curve = Curve([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])
entertainmentrate = Data(["entertainment_google", "3.50000000", "3.50000000", "3.50000000", "3.50000000", "3.50000000"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])
educationrate = Data(["education_google", "4.00000000", "4.00000000", "4.00000000", "4.00000000", "4.00000000"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])
shoppingrate = Data(["shopping_google", "4.20000000", "4.20000000", "4.20000000", "4.20000000", "4.20000000"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])
religionrate = Data(["religion_google", "4.30000000", "4.30000000", "4.30000000", "4.30000000", "4.30000000"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])
area = Area(Geometry=curve)  # -> Area, Centroid
medicalrate = Data(["medical_google", "4.50000000", "4.50000000", "4.50000000", "4.50000000", "4.50000000"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])
publicrate = Data(["public_google", "4.40000000", "4.40000000", "4.40000000", "4.40000000", "4.40000000"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])
officerate = Data(["office_google", "3.50000000", "3.50000000", "3.50000000", "3.50000000", "3.50000000"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])
foodrate = Data(["food_google", "4.10000000", "4.10000000", "4.10000000", "4.10000000", "4.10000000"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])
walkaveragedist1200 = Data(["walkD1200", "106.00000000", "105.00000000", "98.00000000", "95.00000000", "98.00000000"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])
walkaveragedist400 = Data(["walkD400", "108.00000000", "93.00000000", "86.00000000", "92.00000000", "133.00000000"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])
walkaveragedist800 = Data(["walkD800", "109.00000000", "103.00000000", "97.00000000", "104.00000000", "100.00000000"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])
attractivescore1200 = Data(["sum1200", "0.90000000", "0.90000000", "0.85000000", "0.85000000", "0.85000000"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])
attractivescore400 = Data(["sum400", "0.70000000", "0.70000000", "0.70000000", "0.75000000", "0.75000000"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])
attractivescore800 = Data(["sum800", "0.80000000", "0.80000000", "0.85000000", "0.85000000", "0.85000000"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])
cp = ClosestPoint(Point=get_point, Cloud=area.Centroid)  # -> ClosestPoint, CPIndex, Distance
popdense1200 = Data(["popD1200", "56535.00000000", "62287.00000000", "65456.00000000", "61919.00000000", "48228.00000000"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])
blddense1200 = Data(["bldD1200", "0.25000000", "0.25000000", "0.30000000", "0.30000000", "0.30000000"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])
popdense400 = Data(["popD400", "6454.00000000", "7521.00000000", "8184.00000000", "7891.00000000", "5753.00000000"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])
popdense800 = Data(["popD800", "26319.00000000", "29373.00000000", "30722.00000000", "28455.00000000", "19531.00000000"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])
blddense400 = Data(["bldD400", "0.35000000", "0.30000000", "0.25000000", "0.25000000", "0.15000000"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])
blddense800 = Data(["bldD800", "0.25000000", "0.25000000", "0.25000000", "0.25000000", "0.25000000"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])
cluster1200 = Data(["cluster1200", "4.00000000", "4.00000000", "4.00000000", "4.00000000", "4.00000000"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])
merge = Merge(
    Data1=graft(shoppingrate),
    Data2=graft(foodrate),
    Data3=graft(educationrate),
    Data4=graft(entertainmentrate),
    Data5=graft(religionrate),
    Data6=graft(officerate),
    Data7=graft(medicalrate),
    Data8=graft(publicrate))  # -> simplify(Result)
cluster400 = Data(["cluster400", "7.00000000", "7.00000000", "7.00000000", "7.00000000", "7.00000000"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])
cluster800 = Data(["cluster800", "9.00000000", "9.00000000", "2.00000000", "2.00000000", "9.00000000"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])
Z = UnitZ(Factor=Slider(400, range=0..1000))
merge_2 = Merge(Data1=graft(attractivescore400), Data2=graft(attractivescore800), Data3=graft(attractivescore1200))  # -> simplify(Result)
merge_3 = Merge(Data1=graft(popdense400), Data2=graft(popdense800), Data3=graft(popdense1200))  # -> simplify(Result)
merge_4 = Merge(Data1=graft(blddense400), Data2=graft(blddense800), Data3=graft(blddense1200))  # -> simplify(Result)
merge_5 = Merge(Data1=graft(walkaveragedist400), Data2=graft(walkaveragedist800), Data3=graft(walkaveragedist1200))  # -> simplify(Result)
merge_6 = Merge(Data1=graft(cluster400), Data2=graft(cluster800), Data3=graft(cluster1200))  # -> simplify(Result)
addition = Addition(A=cp.CPIndex, B="2")
move = Move(Geometry=cp.ClosestPoint, Motion=Z)  # -> Geometry, Transform
panel = Panel(cp.CPIndex)
panel_2 = Panel("""400
800
1200""")
dots = DotDisplay(Point=move.Geometry, Colour=ColourSwatch(SwatchColor=RGB(255, 238, 0)), Size=Slider(73, range=0..100))
xz = XZPlane(Origin=move.Geometry)
cir = Circle(Plane=cp.ClosestPoint, Radius=panel_2)
flip = FlipMatrix(Data=merge)
panel_3 = Panel(flip)
flip_2 = FlipMatrix(Data=merge_2)
flip_3 = FlipMatrix(Data=merge_3)
flip_4 = FlipMatrix(Data=merge_4)
flip_5 = FlipMatrix(Data=merge_5)
flip_6 = FlipMatrix(Data=merge_6)
index = Data(["index", "0.00000000", "1.00000000", "2.00000000", "3.00000000", "4.00000000"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])
cull_i = CullIndex(List=flip, Indices="0", Wrap=True)
rectangle = Rectangle(Plane=xz, XSize="-1000 to 1000", YSize="0 to 1000", Radius=0)  # -> Rectangle, Length
cull_i_2 = CullIndex(List=index, Indices="0", Wrap=True)
cull_i_3 = CullIndex(List=flip_6, Indices="0", Wrap=True)

# ---- group: Google Rate Amenity
item = ListItem(List=cull_i, Index=addition, Wrap=True)

# ----
panel_4 = Panel("""TOTAL AMENITY RATE :
 Shopping Rate : 
  Food Rate : 
  Education Rate : 
  Entertainment Rate : 
  Religion Rate : 
  Office Rate : 
  Medical Rate : 
  Public Rate : """)
explode = Explode(Curve=rectangle.Rectangle, Recursive=True)  # -> Segments, Vertices

# ---- group: Cluster
item_2 = ListItem(List=cull_i_3, Index=expr("x-1", addition), Wrap=True)

# ---- group: Attractive Score
item_3 = ListItem(List=flip_2, Index=addition, Wrap=True)

# ---- group: Population Density
item_4 = ListItem(List=flip_3, Index=addition, Wrap=True)

# ---- group: Building Density
item_5 = ListItem(List=flip_4, Index=addition, Wrap=True)

# ---- group: Walking Average Distance
item_6 = ListItem(List=flip_5, Index=addition, Wrap=True)

# ----
ma = MassAddition(Input=flatten(item))  # -> Result, PartialResults
num = Number(item)
equals = Equality(FirstNumber=cull_i_3, SecondNumber=item_2)  # -> Equality, Inequality
merge_7 = Merge(Data1=ma.Result, Data2=flatten(num))  # -> graft(Result)
cull = CullPattern(List=cull_i_2, CullPattern=equals.Equality)
merge_8 = Merge(Data1=item_3, Data2=item_4, Data3=item_5, Data4=item_6)
panel_5 = Panel(item_2)
item_7 = ListItem(List=curve, Index=cull, Wrap=True)  # -> simplify(Item)
concat = Concatenate(FragmentA=simplify(graft(panel_4)), FragmentB=merge_7)
item_8 = ListItem(List=explode.Segments, Index="1", Wrap=True)  # -> Item, Item1, Item2
branch = TreeBranch(Tree=simplify(graft(cir)), Path=radius, MaintainPaths=True)
branch_2 = TreeBranch(Tree=merge_8, Path=radius, MaintainPaths=True)
panel_6 = Panel(concat)
ln = Line(StartPoint=move.Geometry, EndPoint=cp.ClosestPoint)
panel_7 = Panel("""  Attractive Score :
  Average Population : 
  Average Building Density : 
  Average Walking porosity distance : """)
branch_3 = TreeBranch(Tree=simplify(item_7), Path=radius, MaintainPaths=True)
panel_8 = Panel("""  Range 400
  Range 800
  Range 1200""")
panel_9 = Panel(""" / 1
 people
 / 1
 m""")
num_2 = Number(branch_2)
branch_4 = TreeBranch(Tree=simplify(graft(panel_8)), Path=radius, MaintainPaths=True)
concat_2 = Concatenate(FragmentA=panel_7, FragmentB=num_2, FragmentC=panel_9)  # -> flatten(Result)
entwine = Entwine(Branch00=flatten(concat), Branch01=concat_2, Branch02=branch_4, FlattenInputs=True)  # -> simplify(graft(Result))
panel_10 = Panel("""400
800
1200""")
pt = ConstructPoint(XCoordinate=0, YCoordinate=0, ZCoordinate=0)
cir_2 = Circle(Plane=pt, Radius=graft(panel_10))  # -> simplify(Circle)
branch_5 = TreeBranch(Tree=cir_2, Path=radius, MaintainPaths=True)
text = Text("Arial")
gate = StreamGate(Stream=flatten(branch_5), Gate=number_slider)  # -> Target0, Target1
crv = Curve(gate.Target0)

get_string = GetString(entwine, AtLeast=1, AtMost=2147483647)
bool = Boolean(True)

lng = ListLength(List=flatten(entwine))
divide = DivideCurve(Curve=item_8.Item, Count=expr("x-1", lng), Kinks=False)  # -> Points, Tangents, Parameters
gate_2 = StreamGate(Stream=get_string, Gate=number_slider)  # -> Target0, Target1
xz_2 = XZPlane(Origin=divide.Points)
ln_2 = Line(StartPoint=divide.Points, EndPoint=move.Geometry)

c_script = CSharpScript(face=text, bold=bool, size=Slider(48, range=0..1000), content=gate_2.Target0, pl=simplify(graft(xz_2)))  # -> out, A; inputs face: String, bold: Boolean, italics: Boolean, size: Double, content: String, pl: Plane
# ---------- c_script: C# usings ----------
using System.IO;
using System.Linq;
using System.Data;
using System.Drawing;
using System.Reflection;
using System.Windows.Forms;
using System.Xml;
using System.Xml.Linq;
using System.Runtime.InteropServices;

using Rhino.DocObjects;
using Rhino.Collections;
using GH_IO;
using GH_IO.Serialization;
# ---------- c_script: C# ----------
    if(size == 0)
      size = 1;

    if(!string.IsNullOrEmpty(face) && size > 0 && !string.IsNullOrEmpty(content) &&
      pl.IsValid)
    {
      using (var doc = Rhino.RhinoDoc.CreateHeadless(null))
      {
        var te = doc.Objects.AddText(content, pl, size, face, bold, italics);
        var txt = doc.Objects.Find(te) as Rhino.DocObjects.TextObject;

        if(txt != null)
        {
          var tt = txt.Geometry as Rhino.Geometry.TextEntity;
          A = tt.Explode();
        }
      }
    }
# ---------- end c_script ----------
crv_2 = Curve(flatten(c_script.A))

c_script_2 = CSharpScript(crv=flatten([ln_2, crv_2, ln, item_8.Item, branch]), color=graft(ColourSwatch(SwatchColor=RGB(255, 238, 0))))  # -> out, A; inputs crv: Curve, color: Color
# ---------- c_script_2: C# ----------
    var c = color.R + "," + color.G + "," + color.B;
    crv.SetUserString("color", c);
    A = crv;
# ---------- end c_script_2 ----------

gate_3 = StreamGate(Stream=c_script_2.A, Gate=number_slider)  # -> Target0, Target1
preview = CustomPreview(Geometry=gate_3.Target0, Material=ColourSwatch(SwatchColor=RGB(255, 238, 0)))
merge_9 = Merge(Data1=gate_3.Target0, Data2=crv)

# ---- group: RH_OUT:Analysis
crv_3 = Curve(merge_9)
