# Grasshopper definition FinalInterface.gh (Grasshopper 1.0.7)
# plug-ins: Pufferfish, MeshEdit Components

# Classification
# Centroids
text = Text(flatten(Tree({0}: ["7"], {1}: ["7"], {2}: ["7"], {3}: ["7"], {4}: ["7"], {5}: ["7"]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)))
# 400m
# Data Set
text_2 = Text(Tree({0}: ["0.05", "0.25", "0.9", "0.85", "1", "0.95", "0.8"], {1}: ["0.15", "0.2", "1", "0.75", "1", "0.95", "0.8"], {2}: ["0.25", "0.3", "0.95", "0.7", "1", "0.95", "0.8"], {3}: ["0.25", "0.35", "0.95", "0.75", "1", "0.95", "0.8"], {4}: ["0.25", "0.35", "1", "0.95", "1", "0.95", "0.8"], {5}: ["0.3", "0.55", "0.95", "0.85", "1", "0.95", "0.8"]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))
text_3 = Text(Tree({0}: ["0.103979534308446", "0.997055347111975", "-0.263689474490521", "0.397175612588454", "0.603564659172404", "-0.236100070400755", "-0.236003469333995", "0.810226194257525"], {1}: ["-0.358638662900312", "-0.532662645833748", "-0.457640434024429", "0.445676641428643", "0.165987551078199", "-0.236100070400754", "-1.23872154122932", "-0.497109438352286"], {2}: ["-0.0195749286529718", "-0.769457295900993", "1.33610326688929", "0.253961400771237", "0.906525940946536", "4.23549217203786", "-0.708781124783708", "0.0542489285846843"], {3}: ["-0.400246947145057", "-0.106084380789949", "-0.403269829749646", "-1.89053058440802", "-1.16403253700156", "-0.236100070400756", "-0.203031072365776", "-1.23246943145033"], {4}: ["3.38584841903168", "1.73966883320981", "-0.159372662927787", "-0.243921350491449", "0.737485439507347", "-0.236100070400756", "0.914140703123639", "2.55082881135498"], {5}: ["-0.300584827578767", "-0.737070771395761", "-0.135470791541697", "0.459756612710264", "-0.0760615103200766", "-0.236100070400754", "0.707190576915565", "-0.339303942074413"], {6}: ["-0.0879295681969858", "-0.599717965284496", "-0.0152817994681131", "-2.00133528828428", "0.707257552026663", "-0.236100070400755", "-0.469042302960748", "-0.971555157147251"], {7}: ["0.134374357618126", "-0.409642944248347", "2.15606500745569", "0.124626584020576", "0.858290783601323", "-0.236100070400755", "0.536855859681442", "0.578235040032025"], {8}: ["2.3238955760692", "1.57417861996192", "0.17079969049786", "-0.363424235045836", "0.865409766991475", "4.23549217203785", "-0.0977383059477592", "2.02518965694603"], {9}: ["-0.447865693440633", "0.658574458861899", "-0.340521625885735", "0.537286110836878", "-1.30042171203745", "-0.236100070400754", "0.768003498073357", "0.0670380176656166"]))
# Lat/Long
text_4 = Text(Tree({0}: ["7457.080322", "4829.67749", "14.22304", "40.836387"], {1}: ["7638.810547", "4942.768066", "14.2251799999999", "40.837385"], {2}: ["8002.27002", "4942.768066", "14.22946", "40.837385"], {3}: ["8184.000488", "4829.67749", "14.2316", "40.836387"], {4}: ["8365.730469", "4490.407227", "14.23374", "40.833395"], {5}: ["8365.730469", "4716.587402", "14.23374", "40.83539"]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))
# Classification
text_5 = Text(flatten(Tree({0}: ["9"], {1}: ["9"], {2}: ["2"], {3}: ["2"], {4}: ["9"], {5}: ["2"]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)))
# 800m
# Data Set
text_6 = Text(Tree({0}: ["0.5", "0.6", "0.9", "0.95", "0.8", "1", "0.85"], {1}: ["0.6", "0.65", "0.95", "0.95", "0.8", "0.95", "0.85"], {2}: ["0.8", "0.7", "1", "0.95", "0.8", "0.9", "0.8"], {3}: ["0.85", "0.65", "1", "0.95", "0.8", "0.85", "0.8"], {4}: ["0.75", "0.5", "0.85", "0.95", "0.85", "0.9", "0.8"], {5}: ["0.9", "0.6", "0.95", "0.95", "0.8", "0.85", "0.8"]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))
# Centroids
text_7 = Text(Tree({0}: ["-0.776366525451621", "-0.996996627608822", "-1.24219705461033", "-0.237042757993216", "0.80152961021354", "-0.398037086437263", "0.883459224743138", "-0.819892052784442"], {1}: ["-0.166057782132203", "0.177519774191224", "0.134808510787606", "-0.237042757993216", "-0.873573850916945", "-0.345897749779022", "-1.39222759338943", "-0.384988921574952"], {2}: ["1.82498979271206", "1.43610064186483", "0.761647681231808", "-0.237042757993216", "0.715688173848214", "0.654672430408749", "-0.988333889117681", "1.59140393856476"], {3}: ["-0.623242362610461", "-0.538726382461105", "0.387224390631017", "-0.237042757993216", "-1.18411680231892", "-0.628972069374956", "0.476218437686582", "-0.535997396419455"], {4}: ["0.283247601611158", "0.179443875375036", "0.589578064987606", "4.21864818172871", "-0.909789945544142", "0.813715282697556", "0.323736548552773", "0.511056819058065"], {5}: ["-0.432583272562306", "-0.152784262363071", "0.393251300339939", "-0.237042757993216", "0.736074093981216", "-0.199756331728639", "0.598665074348201", "-0.161745141795267"], {6}: ["1.47073492187716", "1.46998401402455", "0.687295018597152", "-0.237042757993216", "-0.307614053130797", "-0.320995150960014", "0.54318901093885", "1.46040927915786"], {7}: ["-0.449398381036875", "-0.665274252335196", "-1.12781067535859", "-0.237042757993216", "-0.0402441284254929", "-0.570882715856948", "-1.00539258922745", "-0.893365924712283"], {8}: ["1.77719003295661", "1.46127193968657", "0.91490819111189", "4.21864818172871", "-0.035070660034354", "2.15390376220263", "0.0434127008477671", "1.93555865467306"], {9}: ["0.182937209968705", "0.511884916878823", "0.350201945276232", "-0.237042757993216", "0.58233064879448", "2.12827220897992", "0.107457888983084", "0.719347311776073"]))
# Lat/Long
text_8 = Text(Tree({0}: ["7457.080322", "4829.67749", "14.22304", "40.836387"], {1}: ["7638.810547", "4942.768066", "14.2251799999999", "40.837385"], {2}: ["8002.27002", "4942.768066", "14.22946", "40.837385"], {3}: ["8184.000488", "4829.67749", "14.2316", "40.836387"], {4}: ["8365.730469", "4490.407227", "14.23374", "40.833395"], {5}: ["8365.730469", "4716.587402", "14.23374", "40.83539"]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))

# ---- group: RH_IN:Radius
# Radius around the site to be considered
radius = Slider(1, range=0..2)

# ---- group: RH_IN:SelectAmenities
selectamenities = Slider(10, range=1..10)

# ---- group: RH_IN:AnalysisType
analysistype = Slider(0, range=0..6)

# ----
# Classification
text_9 = Text(flatten(Tree({0}: ["4"], {1}: ["4"], {2}: ["4"], {3}: ["4"], {4}: ["4"], {5}: ["4"]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)))

# ---- group: RH_IN:DisplayAnalysis
# Input
boolean = Boolean(True)

# ----
# 1200m
# Data Set
text_10 = Text(Tree({0}: ["1", "0.65", "0.85", "0.95", "0.8", "1", "0.95"], {1}: ["1", "0.7", "0.8", "0.95", "0.8", "1", "0.95"], {2}: ["1", "0.7", "0.8", "0.95", "0.75", "0.95", "0.95"], {3}: ["1", "0.7", "0.8", "0.9", "0.75", "0.95", "0.95"], {4}: ["1", "0.6", "0.85", "0.95", "0.85", "0.95", "0.95"], {5}: ["1", "0.7", "0.85", "0.9", "0.85", "0.95", "0.95"]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))
# Centroids
text_11 = Text(Tree({0}: ["-0.747611489137118", "-0.599125496799021", "-1.04186402657394", "-0.529339857382214", "0.511083585465842", "0.407214477850142", "-0.240784442382827", "-0.697782007161674"], {1}: ["1.26625652129867", "1.15065503461481", "-0.366539929764063", "-0.31243777377924", "0.612172015924172", "0.370995989525667", "-0.240784442382824", "1.15480786210031"], {2}: ["-0.533913761329282", "-0.64815520718727", "-0.210076825006853", "-0.598443830773374", "-1.16359712260017", "-1.21725364434609", "-0.240784442382825", "-1.00474348942237"], {3}: ["1.07530928083908", "0.733791045806976", "-0.601717087845349", "1.33511118251045", "0.140702103091025", "0.920134437277472", "4.15309224343521", "1.20031208170605"], {4}: ["0.963938262914133", "0.825347893260399", "0.786892643391551", "2.11772178269613", "-0.0848560668383866", "0.931151446213122", "-0.240784442382824", "1.29310393167578"], {5}: ["-0.288888030829095", "-0.122026554004298", "0.937957418479912", "-0.00275061165710509", "0.612320209778255", "-0.313027823751068", "-0.240784442382824", "-0.0731652383688966"], {6}: ["1.13527859019367", "0.197052992188675", "0.0634607075541534", "-0.603154842288476", "-1.44263765424743", "-0.455326317863261", "-0.240784442382825", "0.348133509944819"], {7}: ["-0.983742808711228", "-1.02559938397711", "0.711031310602936", "-0.445139041236404", "0.691469888606025", "-1.30047324184455", "-0.240784442382826", "-0.962622072611143"], {8}: ["-0.462349033632761", "-0.082905852752716", "-0.914924352956373", "-0.188105777699691", "-1.75902179070193", "0.697086137317433", "-0.240784442382825", "-0.511076006106718"], {9}: ["1.28099793395478", "1.90221781597387", "0.479171957640426", "0.0929531925383735", "-0.805371973010941", "0.88288797974211", "-0.240784442382825", "1.46356469782337"]))
# Lat/Long
text_12 = Text(Tree({0}: ["7457.080322", "4829.67749", "14.22304", "40.836387"], {1}: ["7638.810547", "4942.768066", "14.2251799999999", "40.837385"], {2}: ["8002.27002", "4942.768066", "14.22946", "40.837385"], {3}: ["8184.000488", "4829.67749", "14.2316", "40.836387"], {4}: ["8365.730469", "4490.407227", "14.23374", "40.833395"], {5}: ["8365.730469", "4716.587402", "14.23374", "40.83539"]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))
stream_filter = StreamFilter(Gate=radius, Stream0=text_3, Stream1=text_7, Stream2=text_11)
stream_filter_2 = StreamFilter(Gate=radius, Stream0=text_4, Stream1=text_8, Stream2=text_12)
stream_filter_3 = StreamFilter(Gate=radius, Stream0=text_2, Stream1=text_6, Stream2=text_10)
stream_filter_4 = StreamFilter(Gate=radius, Stream0=text, Stream1=text_5, Stream2=text_9)
series = Series(Start="1", Step=1, Count="2476")
series_2 = Series(Start=0, Step=1, Count="2475")
tree_branch = TreeBranch(Tree=stream_filter_2, Path=series, MaintainPaths=False)
tree_branch_2 = TreeBranch(Tree=stream_filter_3, Path=series, MaintainPaths=False)
list_item = ListItem(List=stream_filter_4, Index=series_2, Wrap=True)
cull_index = CullIndex(List=stream_filter, Indices="-1", Wrap=True)
panel = Panel(cull_index)
panel_2 = Panel(tree_branch_2)
panel_3 = Panel(list_item)
absolute = Absolute(Value=cull_index)

# ---- group: points
# The Point
point = Point(Point(90.81114794, 67.97447549, 0))

# ----
points = GetPoint(point, AtLeast=1, AtMost=5, Realtime=True)
number_slider = Slider(0.01, range=0.01..0.1)
curve = Curve([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])
# Connectivity
# Walkability
# Population Density
# Building Density
# Google Maps
# Sentimental
# Outdoor Comfort
text_13 = Text(["Connectivity", "Walkability", "Population Density", "Building Density", "Google Maps", "Sentimental", "Outdoor Comfort"])
scale = Scale(Geometry=curve, Center=Point(0, 0, 0), Factor=number_slider)  # -> Geometry, Transform
list_item_2 = ListItem(List=text_13, Index=analysistype, Wrap=True)
list_length = ListLength(List=scale.Geometry)
list_item_3 = ListItem(List=tree_branch, Index=0, Wrap=True)  # -> Item, Item1
concatenate = Concatenate(Fragment_B="  //     ", A=list_item_2, C="   ", B="Analysis")
panel_4 = Panel(list_length)
panel_5 = Panel(list_item_3.Item)
text_14 = Text(tree_branch_2)
construct_point = ConstructPoint(XCoordinate=Slider(100, range=0..100), YCoordinate=0, ZCoordinate=0)
construct_point_2 = ConstructPoint(XCoordinate=Slider(91, range=0..100), YCoordinate=Slider(8, range=0..100), ZCoordinate=0)
panel_6 = Panel(text_14)
rectangle = Rectangle(Plane=construct_point, XSize=Slider(20, range=0..100), YSize=Domain(-2, 2), Radius=0)  # -> Rectangle, Length

# ----
# Sort Duplicate Values in native GH
list_indices = ListIndices(List=list_item)
series_3 = Series(Start=0, Step=1, Count=10)
create_set = CreateSet(List=series_3)  # -> Set, Map
equality = Equality(FirstNumber=graft(create_set.Set), SecondNumber=list_item)  # -> Equality, Inequality
bounds = Bounds(Numbers=list_item)
dispatch = Dispatch(List=list_indices, DispatchPattern=simplify(equality.Equality))  # -> ListA, ListB
mass_addition = MassAddition(Input=simplify(absolute))  # -> Result, PartialResults
panel_7 = Panel(dispatch.ListA)
param_viewer = ParamViewer(mass_addition.Result)
# Classification Mesh in GH
range = Range(Domain=bounds, Steps=expr("x-1", 10))
deconstruct_domain = DeconstructDomain(Domain=bounds)  # -> Start, End
list_item_4 = ListItem(List=scale.Geometry, Index=dispatch.ListA, Wrap=True)
gradient = Gradient(
    LowerLimit=0,
    UpperLimit=deconstruct_domain.End,
    Parameter=range,
    stops=[0.15: RGB(255, 130, 160), 0.85: RGB(220, 0, 40)])
sort_list = SortList(Keys=flatten(mass_addition.Result), ValuesValuesA=simplify(param_viewer))  # -> Keys, ValuesValuesA
list_length_2 = ListLength(List=param_viewer)
surface = Surface(list_item_4)
series_4 = Series(Start=0, Step=1, Count=list_length_2)
data_path = DataPath(series_4)
replace_paths = ReplacePaths(Data=surface, Search=sort_list.ValuesValuesA, Replace=data_path)
mesh = Mesh(replace_paths)
mesh_colours = MeshColours(Mesh=mesh, Colours=graft(gradient))

flatten_tree = FlattenTree(Tree=scale.Geometry, Path="{0}")
area = Area(Geometry=flatten_tree)  # -> Area, Centroid
closest_point = ClosestPoint(Point=points, Cloud=area.Centroid)  # -> ClosestPoint, CPIndex, Distance
# Selected Mesh Display
surface_2 = Surface(flatten_tree)
list_item_5 = ListItem(List=surface_2, Index=closest_point.CPIndex, Wrap=True)
mesh_colours_2 = MeshColours(Mesh=list_item_5, Colours=ColourSwatch(SwatchColor=RGB(60, 0, 255)))

# ----
# -- Analysis Title
c_script = CSharpScript(face="Arial", bold=Toggle(False), size=Slider(1.906, range=0..11), content=concatenate, pl=construct_point_2)  # -> out, A; inputs face: String, bold: Boolean, italics: Boolean, size: Double, content: String, pl: Plane
# ---------- c_script: C# usings ----------
using System.IO;
using System.Linq;
using System.Data;
using System.Drawing;
using System.Reflection;
using System.Windows.Forms;
using System.Xml;
using System.Xml.Linq;
using System.Runtime.InteropServices;

using Rhino.DocObjects;
using Rhino.Collections;
using GH_IO;
using GH_IO.Serialization;
# ---------- c_script: C# ----------
    if(size == 0)
      size = 1;

    if(!string.IsNullOrEmpty(face) && size > 0 && !string.IsNullOrEmpty(content) &&
      pl.IsValid)
    {
      using (var doc = Rhino.RhinoDoc.CreateHeadless(null))
      {
        var te = doc.Objects.AddText(content, pl, size, face, bold, italics);
        var txt = doc.Objects.Find(te) as Rhino.DocObjects.TextObject;

        if(txt != null)
        {
          var tt = txt.Geometry as Rhino.Geometry.TextEntity;
          A = tt.Explode();
        }
      }
    }
# ---------- end c_script ----------
curve_2 = Curve(c_script.A)
deconstruct_brep = DeconstructBrep(Brep=rectangle.Rectangle)  # -> Faces, Edges, Vertices
mesh_colours_3 = MeshColours(Mesh=curve_2, Colours=ColourSwatch(SwatchColor=RGB(255, 255, 255)))
unit_y = UnitY(Factor=expr("-x", 1))
list_item_6 = ListItem(List=deconstruct_brep.Edges, Index=0, Wrap=True)
move = Move(Geometry=list_item_6, Motion=unit_y)  # -> Geometry, Transform
explode = Explode(Curve=move.Geometry, Recursive=True)  # -> Segments, Vertices
boolean_toggle = BooleanToggle(False)
slider = Slider(1.422, range=0..11)
list_item_7 = ListItem(List=explode.Vertices, Index=0, Wrap=True)  # -> Item, Item1
number_slider_2 = Slider(26, range=0..100)
text_15 = Text(dispatch.ListA)
panel_9 = Panel(closest_point.CPIndex)
c_script_2 = CSharpScript(face="Arial", bold=boolean_toggle, size=slider, content="least", pl=list_item_7.Item)  # -> out, A; inputs face: String, bold: Boolean, italics: Boolean, size: Double, content: String, pl: Plane; same code as c_script
c_script_3 = CSharpScript(face="Arial", bold=boolean_toggle, size=slider, content="most", pl=list_item_7.Item1)  # -> out, A; inputs face: String, bold: Boolean, italics: Boolean, size: Double, content: String, pl: Plane; same code as c_script
text_16 = Text(closest_point.CPIndex)
mesh_surface = MeshSurface(Surface=rectangle.Rectangle, UCount=number_slider_2, VCount=number_slider_2, Overhang=True, Equalize=False)
member_index = MemberIndex(Set=text_15, Member=text_16)  # -> simplify(Index), Count
curve_3 = Curve(c_script_2.A)
curve_4 = Curve(c_script_3.A)
deconstruct_mesh = DeconstructMesh(Mesh=mesh_surface)  # -> Vertices, Faces, Colours, Normals
mesh_colours_4 = MeshColours(Mesh=curve_3, Colours=ColourSwatch(SwatchColor=RGB(255, 255, 255)))
mesh_colours_5 = MeshColours(Mesh=curve_4, Colours=ColourSwatch(SwatchColor=RGB(255, 255, 255)))
clean_tree = CleanTree(RemoveNulls=True, RemoveInvalid=True, RemoveEmpty=invert(False), Tree=member_index.Index)  # -> simplify(Tree)
deconstruct = Deconstruct(Point=deconstruct_mesh.Vertices)  # -> XComponent, YComponent, ZComponent
panel_10 = Panel(clean_tree)
tree_statistics = TreeStatistics(Tree=simplify(clean_tree))  # -> Paths, Length, Count
bounds_2 = Bounds(Numbers=deconstruct.XComponent)
deconstruct_domain_2 = DeconstructDomain(Domain=bounds_2)  # -> Start, End
panel_11 = Panel(tree_statistics.Paths)
tree_branch_3 = TreeBranch(Tree=simplify(surface), Path=tree_statistics.Paths, MaintainPaths=True)
area_2 = Area(Geometry=tree_branch_3)  # -> Area, Centroid
area_3 = Area(Geometry=scale.Geometry)  # -> Area, Centroid
tree_branch_4 = TreeBranch(Tree=simplify(text_14), Path=closest_point.CPIndex, MaintainPaths=True)
closest_point_2 = ClosestPoint(Point=area_2.Centroid, Cloud=area_3.Centroid)  # -> ClosestPoint, CPIndex, Distance
gradient_2 = Gradient(
    LowerLimit=deconstruct_domain_2.Start,
    UpperLimit=deconstruct_domain_2.End,
    Parameter=deconstruct.XComponent,
    stops=[0.15: RGBA(255, 255, 255, 0), 0.85: RGB(64, 64, 64)])
gradient_3 = Gradient(
    LowerLimit=deconstruct_domain_2.Start,
    UpperLimit=deconstruct_domain_2.End,
    Parameter=deconstruct.XComponent,
    stops=[0.303: RGBA(237, 237, 255, 0), 0.994: RGB(128, 128, 255)])
gradient_4 = Gradient(
    LowerLimit=deconstruct_domain_2.Start,
    UpperLimit=deconstruct_domain_2.End,
    Parameter=deconstruct.XComponent,
    stops=[0.679: RGBA(255, 232, 255, 0), 0.85: RGB(212, 0, 219)])
gradient_5 = Gradient(
    LowerLimit=deconstruct_domain_2.Start,
    UpperLimit=deconstruct_domain_2.End,
    Parameter=deconstruct.XComponent,
    stops=[0.637: RGBA(255, 233, 212, 0), 0.85: RGB(255, 128, 0)])
gradient_6 = Gradient(
    LowerLimit=deconstruct_domain_2.Start,
    UpperLimit=deconstruct_domain_2.End,
    Parameter=deconstruct.XComponent,
    stops=[0.346: RGBA(237, 237, 255, 0), 1: RGB(0, 128, 128)])
gradient_7 = Gradient(
    LowerLimit=deconstruct_domain_2.Start,
    UpperLimit=deconstruct_domain_2.End,
    Parameter=deconstruct.XComponent,
    stops=[0.663: RGBA(223, 228, 247, 0), 0.85: RGB(25, 25, 112)])
gradient_8 = Gradient(
    LowerLimit=deconstruct_domain_2.Start,
    UpperLimit=deconstruct_domain_2.End,
    Parameter=deconstruct.XComponent,
    stops=[0.15: RGBA(255, 255, 212, 0), 0.85: RGB(0, 128, 0)])
mass_addition_2 = MassAddition(Input=tree_branch_4)  # -> Result, PartialResults
tree_branch_5 = TreeBranch(Tree=text_14, Path=closest_point_2.CPIndex, MaintainPaths=False)
list_item_8 = ListItem(List=scale.Geometry, Index=closest_point_2.CPIndex, Wrap=True)
entwine = Entwine(
    Branch00=gradient_2,
    Branch01=gradient_3,
    Branch02=gradient_4,
    Branch03=gradient_5,
    Branch04=gradient_6,
    Branch05=gradient_7,
    Branch06=gradient_8,
    FlattenInputs=True)  # -> simplify(Result)
panel_12 = Panel(mass_addition_2.Result)
mass_addition_3 = MassAddition(Input=tree_branch_5)  # -> flatten(Result), PartialResults
tree_branch_6 = TreeBranch(Tree=entwine, Path=analysistype, MaintainPaths=True)
series_5 = Series(Start=mass_addition_2.Result, Step="0.1", Count=selectamenities)
xy_plane = XYPlane(Origin=Point(0, 0, 0))
construct_mesh = ConstructMesh(Vertices=deconstruct_mesh.Vertices, Faces=deconstruct_mesh.Faces, Colours=tree_branch_6)
series_6 = Series(Start=0, Step=Slider(5, range=0..10), Count=10)
text_17 = Text(mass_addition_3.Result)
text_18 = Text(series_5)
text_19 = Text(mass_addition_3.Result)
unit_z = UnitZ(Factor=series_6)
member_index_2 = MemberIndex(Set=text_17, Member=text_18)  # -> flatten(Index), Count
move_2 = Move(Geometry=xy_plane, Motion=unit_z)  # -> Geometry, Transform
series_7 = Series(Start=0, Step=1, Count=selectamenities)

# ----
# Connectivity
# Walkability
# Population Density
# Building Density
# Google Maps
# Sentimental
# Outdoor Comfort
# Connectivity
# Walkability
# Population Density
# Building Density
# Google Maps
# Sentimental
# Outdoor Comfort
round_to_decimal_place = RoundToDecimalPlace(NumberX=tree_branch_4, DecimalPlace=2, RoundType=0)  # -> Rounded, Difference

list_item_9 = ListItem(List=member_index_2.Index, Index=series_7, Wrap=True)
list_item_10 = ListItem(List=text_19, Index=list_item_9, Wrap=True)
list_item_11 = ListItem(List=list_item_8, Index=list_item_9, Wrap=True)
# Calculating similar atrractivity
subtraction = Subtraction(A=mass_addition_2.Result, B=list_item_10)
absolute_2 = Absolute(Value=subtraction)
area_4 = Area(Geometry=list_item_11)  # -> Area, Centroid
division = Division(A=absolute_2, B=mass_addition_2.Result)
number = Number(100)
closest_point_3 = ClosestPoint(Point=points, Cloud=area_4.Centroid)  # -> ClosestPoint, CPIndex, Distance
number_2 = Number(expr("x*100", division))
panel_13 = Panel(number)
subtraction_2 = Subtraction(A=number, B=number_2)
cull_index_2 = CullIndex(List=list_item_11, Indices=closest_point_3.CPIndex, Wrap=True)

# ---- group: RH_OUT:AnalysisTitle
# Output
# Analysis Title
mesh_2 = Mesh(mesh_colours_3)

# Attractivity of selected locality
text_20 = Text(concatenate)

# ---- group: RH_OUT:AttractivityData
number_3 = Number(round_to_decimal_place.Rounded)

# ---- group: RH_OUT:ClassificationMesh
# Classification Mesh
mesh_3 = Mesh(mesh_colours)

# ---- group: RH_OUT:SelectedMesh
# Selected Locality Coloured Blue
mesh_4 = Mesh(mesh_colours_2)

# ---- group: RH_OUTGradientLegend
# Gradient mesh
rh_out_mesh = Mesh(flatten([construct_mesh, mesh_colours_4, mesh_colours_5]))

# ---- group: RH_OUT:Attractivity
number_4 = Number(mass_addition_2.Result)

# ----
round_to_decimal_place_2 = RoundToDecimalPlace(NumberX=subtraction_2, DecimalPlace=1, RoundType=0)  # -> Rounded, Difference
mesh_colours_6 = MeshColours(Mesh=cull_index_2, Colours=ColourSwatch(SwatchColor=RGB(70, 191, 255)))

# ---- group: RH_OUT:SimilarMesh
mesh_5 = Mesh(mesh_colours_6)

# ----
panel_14 = Panel(round_to_decimal_place_2.Rounded)
bool = Boolean(True)
number_slider_3 = Slider(0.01, range=0..0.01)
c_script_4 = CSharpScript(
    face="Arial",
    bold=Toggle(False),
    size=Slider(0.709, range=0..11),
    content=round_to_decimal_place_2.Rounded,
    pl=area_4.Centroid)  # -> out, A; inputs face: String, bold: Boolean, italics: Boolean, size: Double, content: String, pl: Plane; same code as c_script
number_slider_4 = Slider(0.1, range=0..0.1)
curve_5 = Curve(c_script_4.A)
unit_z_2 = UnitZ(Factor=Slider(0.4, range=0..1))
move_3 = Move(Geometry=curve_5, Motion=unit_z_2)  # -> Geometry, Transform
mesh_colours_7 = MeshColours(Mesh=move_3.Geometry, Colours=ColourSwatch(SwatchColor=RGB(255, 255, 255)))

# ---- group: RH_OUT:PercentSimilarity
mesh_6 = Mesh(mesh_colours_7)

# ----
panel_15 = Panel("46")  # disabled
panel_16 = Panel("8")  # disabled
series_8 = Series(Start=panel_15, Step=1, Count=panel_16)  # disabled

# ---- group: 1200
panel_17 = Panel("3")  # disabled
panel_18 = Panel("31")  # disabled
panel_19 = Panel("3")  # disabled
series_9 = Series(Start=panel_18, Step=panel_17, Count=panel_19)  # disabled

# ---- group: 800
panel_20 = Panel("3")  # disabled
panel_21 = Panel("30")  # disabled
panel_22 = Panel("3")  # disabled
series_10 = Series(Start=panel_21, Step=panel_20, Count=panel_22)  # disabled

# ---- group: 400
panel_23 = Panel("3")  # disabled
panel_24 = Panel("29")  # disabled
panel_25 = Panel("3")  # disabled
series_11 = Series(Start=panel_24, Step=panel_23, Count=panel_25)  # disabled

# ----
panel_26 = Panel("38")  # disabled
panel_27 = Panel("8")  # disabled
series_12 = Series(Start=panel_26, Step=1, Count=panel_27)  # disabled

# ----
# Connectivity
# Walkability
# Population Density
# Building Density
# Google Maps
# Sentimental
# Outdoor Comfort
list_item_12 = ListItem(List=tree_branch_2, Index=analysistype, Wrap=True)
bounds_3 = Bounds(Numbers=flatten(list_item_12))
deconstruct_domain_3 = DeconstructDomain(Domain=bounds_3)  # -> Start, End
number_5 = Number(flatten(list_item_12))
construct_point_3 = ConstructPoint(XCoordinate=list_item_3.Item, YCoordinate=list_item_3.Item1, ZCoordinate=0)
unit_z_3 = UnitZ(Factor=list_item_12)
gradient_9 = Gradient(
    LowerLimit=deconstruct_domain_3.Start,
    UpperLimit=deconstruct_domain_3.End,
    Parameter=number_5,
    stops=[0.15: RGBA(255, 255, 255, 0), 0.85: RGB(64, 64, 64)])
gradient_10 = Gradient(
    LowerLimit=deconstruct_domain_3.Start,
    UpperLimit=deconstruct_domain_3.End,
    Parameter=number_5,
    stops=[0.303: RGBA(237, 237, 255, 0), 0.994: RGB(128, 128, 255)])
gradient_11 = Gradient(
    LowerLimit=deconstruct_domain_3.Start,
    UpperLimit=deconstruct_domain_3.End,
    Parameter=number_5,
    stops=[0.679: RGBA(255, 232, 255, 0), 0.85: RGB(212, 0, 219)])
gradient_12 = Gradient(
    LowerLimit=deconstruct_domain_3.Start,
    UpperLimit=deconstruct_domain_3.End,
    Parameter=number_5,
    stops=[0.637: RGBA(255, 233, 212, 0), 0.85: RGB(255, 128, 0)])
gradient_13 = Gradient(
    LowerLimit=deconstruct_domain_3.Start,
    UpperLimit=deconstruct_domain_3.End,
    Parameter=number_5,
    stops=[0.346: RGBA(237, 237, 255, 0), 1: RGB(0, 128, 128)])
gradient_14 = Gradient(
    LowerLimit=deconstruct_domain_3.Start,
    UpperLimit=deconstruct_domain_3.End,
    Parameter=number_5,
    stops=[0.663: RGBA(223, 228, 247, 0), 0.85: RGB(25, 25, 112)])
gradient_15 = Gradient(
    LowerLimit=deconstruct_domain_3.Start,
    UpperLimit=deconstruct_domain_3.End,
    Parameter=number_5,
    stops=[0.15: RGBA(255, 255, 212, 0), 0.85: RGB(0, 128, 0)])
multiplication = Multiplication(A=unit_z_3, B=Slider(21, range=0..100))
# Analysis Display
entwine_2 = Entwine(
    Branch00=gradient_9,
    Branch01=gradient_10,
    Branch02=gradient_11,
    Branch03=gradient_12,
    Branch04=gradient_13,
    Branch05=gradient_14,
    Branch06=gradient_15,
    FlattenInputs=True)  # -> simplify(Result)
tree_branch_7 = TreeBranch(Tree=entwine_2, Path=analysistype, MaintainPaths=True)
curve_6 = Curve(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)
unit_z_4 = UnitZ(Factor=Slider(34, range=0..100))
boolean_2 = Boolean(boolean)

scale_2 = Scale(Geometry=construct_point_3, Center=Point(0, 0, 0), Factor=number_slider)  # -> Geometry, Transform
scale_3 = Scale(Geometry=curve_6, Center=Point(0, 0, 0), Factor=number_slider)  # -> Geometry, Transform

number_6 = Number([400, 800, 1200])
panel_28 = Panel(number_6)
list_item_13 = ListItem(List=number_6, Index=radius, Wrap=True)
point_2 = Point(points)
surface_3 = Surface(Tree({0;0}: [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], {0;1}: [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], {0;2}: [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], {0;3}: [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], {0;4}: [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], {0;5}: [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], {0;6}: [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], {0;7}: [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]))
circle = Circle(Plane=point_2, Radius=list_item_13)
text_21 = Text(["retail", "food", "education", "entertainment", "religion", "commercial", "healthcare", "public"])
panel_29 = Panel(text_21)

scale_4 = Scale(Geometry=surface_3, Center=Point(0, 0, 0), Factor=number_slider)  # -> Geometry, Transform

move_4 = Move(Geometry=scale_2.Geometry, Motion=multiplication)  # -> flatten(Geometry), Transform
delaunay_mesh = DelaunayMesh(Points=move_4.Geometry, Plane=PlaneXY(0, 0, 0))
mesh_colours_8 = MeshColours(Mesh=delaunay_mesh, Colours=tree_branch_7)
mesh_explode = MeshExplode(Mesh=mesh_colours_8, Interpolate=False)
area_5 = Area(Geometry=mesh_colours_8)  # -> Area, Centroid
mesh_area = MeshArea(Mesh=mesh_explode)  # -> Area, Centroid
project = Project(Geometry=mesh_area.Centroid, Plane=PlaneXY(0, 0, 0))  # -> Geometry, Transform
project_2 = Project(Geometry=area_5.Centroid, Plane=PlaneXY(0, 0, 0))  # -> Geometry, Transform
point_in_curve = PointInCurve(Point=project.Geometry, Curve=scale_3.Geometry)  # -> Relationship, Point
dispatch_2 = Dispatch(List=mesh_explode, DispatchPattern=point_in_curve.Relationship)  # -> ListA, ListB
mesh_7 = Mesh(dispatch_2.ListA)
move_5 = Move(Geometry=project_2.Geometry, Motion=unit_z_4)  # -> Geometry, Transform

orient = Orient(Geometry=mesh_7, Source=area_5.Centroid, Target=move_5.Geometry)  # -> Geometry, Transform

stream_filter_5 = StreamFilter(Gate=boolean_2, Stream1=orient.Geometry)

mesh_join = MeshJoin(Meshes=stream_filter_5)
mesh_plane = MeshPlane(Mesh=mesh_join, Plane=move_2.Geometry)
list_length_3 = ListLength(List=mesh_plane)
repeat_data = RepeatData(Data=ColourSwatch(SwatchColor=RGB(115, 115, 115)), Length=list_length_3)
clean_tree_2 = CleanTree(RemoveNulls=True, RemoveInvalid=True, RemoveEmpty=invert(False), Tree=mesh_plane)
c_script_5 = CSharpScript(crv=clean_tree_2, color=repeat_data)  # -> out, A; inputs crv: Curve, color: Color
# ---------- c_script_5: C# ----------
    var c = color.R + "," + color.G + "," + color.B;
    crv.SetUserString("color", c);
    A = crv;
# ---------- end c_script_5 ----------

# ---- group: RH_OUT:AnalysisMesh
# Analysis fancy mesh
rh_out_mesh_2 = Mesh(mesh_join)

# ---- group: RH_OUT:Contours
curve_7 = Curve(flatten(c_script_5.A))

# ----
area_6 = Area(Geometry=scale_4.Geometry)  # -> Area, Centroid
point_in_curve_2 = PointInCurve(Point=area_6.Centroid, Curve=circle)  # -> Relationship, Point
dispatch_3 = Dispatch(List=area_6.Centroid, DispatchPattern=point_in_curve_2.Relationship)  # -> ListA, ListB
point_3 = Point(dispatch_3.ListA)
line = Line(StartPoint=point_2, EndPoint=point_3)  # -> simplify(Line)
list_length_4 = ListLength(List=simplify(line))
length = Length(Curve=line)
clean_tree_3 = CleanTree(RemoveNulls=True, RemoveInvalid=True, RemoveEmpty=invert(False), Tree=length)  # -> simplify(Tree)
clean_tree_4 = CleanTree(RemoveNulls=True, RemoveInvalid=True, RemoveEmpty=invert(False), Tree=line)
panel_31 = Panel(list_length_4)
bounds_4 = Bounds(Numbers=clean_tree_3)
# Amenity Graphs
panel_32 = Panel(clean_tree_3)
text_22 = Text(clean_tree_3)
deconstruct_domain_4 = DeconstructDomain(Domain=bounds_4)  # -> Start, End
panel_33 = Panel(deconstruct_domain_4.Start)
text_23 = Text(deconstruct_domain_4.Start)
member_index_3 = MemberIndex(Set=text_22, Member=text_23)  # -> simplify(Index), Count
list_item_14 = ListItem(List=simplify(clean_tree_4), Index=member_index_3.Index, Wrap=True)  # -> simplify(Item)
tree_statistics_2 = TreeStatistics(Tree=member_index_3.Index)  # -> simplify(Paths), Length, Count
panel_34 = Panel(member_index_3.Index)
end_points = EndPoints(Curve=list_item_14)  # -> Start, End
filtered_amenity_s_branches = Panel(tree_statistics_2.Paths)

deconstruct_path = DeconstructPath(Branch=tree_statistics_2.Paths)  # -> flatten(Indices)
panel_35 = Panel(deconstruct_path)

cull_index_3 = CullIndex(List=text_21, Indices=deconstruct_path, Wrap=True)
list_item_15 = ListItem(List=text_21, Index=deconstruct_path, Wrap=True)
text_24 = Text(list_item_15)
text_25 = Text(cull_index_3)
concatenate_2 = Concatenate(FragmentA="//   ", FragmentB=text_24)
concatenate_3 = Concatenate(FragmentA="//   ", FragmentB=text_25)
merge = Merge(Data1="Amenities Available", Data2=concatenate_2, Data4="Amenities Unavailable", Data5=concatenate_3)  # -> flatten(Result)

panel_36 = Panel(list_item_15)
panel_37 = Panel(cull_index_3)

# ---- group: RH_OUT:PieChartData
# Data for Pie Chart
number_7 = Number(flatten(list_length_4))

# ---- group: RH_OUT:AmenitiesAvailable
# Amenities Available / Unavailable
text_26 = Text(concatenate_2)

# ---- group: RH_OUT:AmenitiesUnavailable
text_27 = Text(concatenate_3)

# ----
# Amenity Rate < 1200
# Amenity Distance < 1200
# 0 POP density
# 1 BLD density
# 2 Walkability
text_28 = Text(Tree({1}: ["conscore400", "conscore800", "conscore1200", "walkscore400", "walkscore800", "walkscore1200", "popscore400", "popscore800", "popscore1200", "bldscore400", "bldscore800", "bldscore1200", "ratescore400", "ratescore800", "ratescore1200", "senscore400", "senscore800", "senscore1200", "comfscore400", "comfscore800", "comfscore1200", "sum400", "sum800", "sum1200", "long", "lat", "y", "x", "popD400", "popD800", "popD1200", "bldD400", "bldD800", "bldD1200", "walkD400", "walkD800", "walkD1200", "shopping_osm", "food_osm", "education_osm", "entertainment_osm", "religion_osm", "office_osm", "medical_osm", "public_osm", "shopping_google", "food_google", "education_google", "entertainment_google", "religion_google", "office_google", "medical_google", "public_google", "number"], {2}: ["0.05", "0.5", "1", "0.25", "0.6", "0.65", "0.9", "0.9", "0.85", "0.85", "0.95", "0.95", "1", "0.8", "0.8", "0.95", "1", "1", "0.8", "0.85", "0.95", "0.7", "0.8", "0.9", "40.836387", "14.22304", "4829.67749", "7457.080322", "6454", "26319", "56535", "0.35", "0.25", "0.25", "108", "109", "106", "0", "590", "1020", "0", "220", "460", "390", "550", "4.2", "4.1", "4", "3.5", "4.3", "3.5", "4.5", "4.4", "0"], {3}: ["0.15", "0.6", "1", "0.2", "0.65", "0.7", "1", "0.95", "0.8", "0.75", "0.95", "0.95", "1", "0.8", "0.8", "0.95", "0.95", "1", "0.8", "0.85", "0.95", "0.7", "0.8", "0.9", "40.837385", "14.22518", "4942.768066", "7638.810547", "7521", "29373", "62287", "0.3", "0.25", "0.25", "93", "103", "105", "1090", "380", "1190", "0", "200", "560", "190", "620", "4.2", "4.1", "4", "3.5", "4.3", "3.5", "4.5", "4.4", "1"], {4}: ["0.25", "0.8", "1", "0.3", "0.7", "0.7", "0.95", "1", "0.8", "0.7", "0.95", "0.95", "1", "0.8", "0.75", "0.95", "0.9", "0.95", "0.8", "0.8", "0.95", "0.7", "0.85", "0.85", "40.837385", "14.22946", "4942.768066", "8002.27002", "8184", "30722", "65456", "0.25", "0.25", "0.3", "86", "97", "98", "870", "330", "1130", "1160", "140", "700", "170", "700", "4.2", "4.1", "4", "3.5", "4.3", "3.5", "4.5", "4.4", "2"], {5}: ["0.25", "0.85", "1", "0.35", "0.65", "0.7", "0.95", "1", "0.8", "0.75", "0.95", "0.9", "1", "0.8", "0.75", "0.95", "0.85", "0.95", "0.8", "0.8", "0.95", "0.75", "0.85", "0.85", "40.836387", "14.2316", "4829.67749", "8184.000488", "7891", "28455", "61919", "0.25", "0.25", "0.3", "92", "104", "95", "910", "320", "990", "970", "80", "750", "370", "720", "4.2", "4.1", "4", "3.5", "4.3", "3.5", "4.5", "4.4", "3"], {6}: ["0.25", "0.75", "1", "0.35", "0.5", "0.6", "1", "0.85", "0.85", "0.95", "0.95", "0.95", "1", "0.85", "0.85", "0.95", "0.9", "0.95", "0.8", "0.8", "0.95", "0.75", "0.85", "0.85", "40.833395", "14.23374", "4490.407227", "8365.730469", "5753", "19531", "48228", "0.15", "0.25", "0.3", "133", "100", "98", "0", "40", "940", "880", "260", "790", "690", "710", "4.2", "4.1", "4", "3.5", "4.3", "3.5", "4.5", "4.4", "4"]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))  # disabled
panel_38 = Panel(text_28)  # disabled
panel_39 = Panel("1")  # disabled
text_29 = Text(Tree({1}: ["conscore400", "0.05", "0.15", "0.25", "0.25", "0.25"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], {2}: ["conscore800", "0.5", "0.6", "0.8", "0.85", "0.75"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], {3}: ["conscore1200", "1", "1", "1", "1", "1"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], {4}: ["walkscore400", "0.25", "0.2", "0.3", "0.35", "0.35"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], {5}: ["walkscore800", "0.6", "0.65", "0.7", "0.65", "0.5"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], {6}: ["walkscore1200", "0.65", "0.7", "0.7", "0.7", "0.6"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]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))  # disabled
panel_40 = Panel("0")  # disabled
cull_i = CullIndex(List=text_29, Indices=panel_40, Wrap=True)  # -> simplify(List); disabled
panel_41 = Panel("""27
28""")  # disabled
branch = TreeBranch(Tree=cull_i, Path=panel_41, MaintainPaths=True)  # disabled
branch_2 = TreeBranch(Tree=cull_i, Path=series_8, MaintainPaths=True)  # disabled
branch_3 = TreeBranch(Tree=cull_i, Path=series_12, MaintainPaths=True)  # disabled
branch_4 = TreeBranch(Tree=cull_i, Path=series_11, MaintainPaths=True)  # disabled
branch_5 = TreeBranch(Tree=cull_i, Path=series_10, MaintainPaths=True)  # disabled
branch_6 = TreeBranch(Tree=cull_i, Path=series_9, MaintainPaths=True)  # disabled
flip = FlipMatrix(Data=branch)  # disabled
item = ListItem(List=flip, Index=0, Wrap=True)  # -> simplify(Item), Item1; disabled
pt = ConstructPoint(XCoordinate=item.Item1, YCoordinate=item.Item, ZCoordinate=0)  # -> flatten(Point); disabled
panel_42 = Panel(item.Item)  # disabled
panel_43 = Panel("""Population Density = 
Building Density = 
Walkability = """)  # disabled
panel_44 = Panel(" = ")  # disabled
panel_45 = Panel(" = ")  # disabled

# ---- group: column features
branch_7 = TreeBranch(Tree=text_28, Path=panel_39, MaintainPaths=True)  # disabled

# ---- group: amenity rate around this location
flip_2 = FlipMatrix(Data=branch_2)  # disabled

# ---- group: closest amenity distance
flip_3 = FlipMatrix(Data=branch_3)  # disabled

# ---- group: 400
flip_4 = FlipMatrix(Data=branch_4)  # disabled

# ---- group: 800
flip_5 = FlipMatrix(Data=branch_5)  # disabled

# ---- group: 1200
flip_6 = FlipMatrix(Data=branch_6)  # disabled

# ----
panel_46 = Panel(branch_7)  # disabled
# Optional
item_2 = ListItem(List=branch_7, Index=expr("x-1", series_8), Wrap=True)  # disabled
item_3 = ListItem(List=branch_7, Index=expr("x-1", series_12), Wrap=True)  # disabled
panel_47 = Panel(item_2)  # disabled
panel_48 = Panel(item_3)  # disabled
concat = Concatenate(FragmentA=panel_47, FragmentC=panel_44, FragmentB=flip_2)  # disabled
concat_2 = Concatenate(FragmentA=panel_48, FragmentC=panel_45, FragmentB=flip_3)  # disabled
concat_3 = Concatenate(FragmentA=panel_43, FragmentB=flip_4)  # disabled
concat_4 = Concatenate(FragmentA=panel_43, FragmentB=flip_5)  # disabled
concat_5 = Concatenate(FragmentA=panel_43, FragmentB=flip_6)  # disabled
panel_49 = Panel(concat)  # disabled
panel_50 = Panel(concat_3)  # disabled
panel_51 = Panel(concat_4)  # disabled
panel_52 = Panel(concat_5)  # disabled
panel_53 = Panel(concat_2)  # disabled
