# Grasshopper definition FinalInterface_final.gh (Grasshopper 1.0.7)
# plug-ins: Pufferfish

# Classification
# Centroids
text = Text(flatten(Tree({0}: ["7"], {1}: ["7"], {2}: ["7"], {3}: ["7"], {4}: ["7"], {5}: ["7"]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)))
# 400m
# Data Set
text_2 = Text(Tree({0}: ["0.05", "0.25", "0.9", "0.85", "1", "0.95", "0.8"], {1}: ["0.15", "0.2", "1", "0.75", "1", "0.95", "0.8"], {2}: ["0.25", "0.3", "0.95", "0.7", "1", "0.95", "0.8"], {3}: ["0.25", "0.35", "0.95", "0.75", "1", "0.95", "0.8"], {4}: ["0.25", "0.35", "1", "0.95", "1", "0.95", "0.8"], {5}: ["0.3", "0.55", "0.95", "0.85", "1", "0.95", "0.8"]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))
text_3 = Text(Tree({0}: ["0.103979534308446", "0.997055347111975", "-0.263689474490521", "0.397175612588454", "0.603564659172404", "-0.236100070400755", "-0.236003469333995", "0.810226194257525"], {1}: ["-0.358638662900312", "-0.532662645833748", "-0.457640434024429", "0.445676641428643", "0.165987551078199", "-0.236100070400754", "-1.23872154122932", "-0.497109438352286"], {2}: ["-0.0195749286529718", "-0.769457295900993", "1.33610326688929", "0.253961400771237", "0.906525940946536", "4.23549217203786", "-0.708781124783708", "0.0542489285846843"], {3}: ["-0.400246947145057", "-0.106084380789949", "-0.403269829749646", "-1.89053058440802", "-1.16403253700156", "-0.236100070400756", "-0.203031072365776", "-1.23246943145033"], {4}: ["3.38584841903168", "1.73966883320981", "-0.159372662927787", "-0.243921350491449", "0.737485439507347", "-0.236100070400756", "0.914140703123639", "2.55082881135498"], {5}: ["-0.300584827578767", "-0.737070771395761", "-0.135470791541697", "0.459756612710264", "-0.0760615103200766", "-0.236100070400754", "0.707190576915565", "-0.339303942074413"], {6}: ["-0.0879295681969858", "-0.599717965284496", "-0.0152817994681131", "-2.00133528828428", "0.707257552026663", "-0.236100070400755", "-0.469042302960748", "-0.971555157147251"], {7}: ["0.134374357618126", "-0.409642944248347", "2.15606500745569", "0.124626584020576", "0.858290783601323", "-0.236100070400755", "0.536855859681442", "0.578235040032025"], {8}: ["2.3238955760692", "1.57417861996192", "0.17079969049786", "-0.363424235045836", "0.865409766991475", "4.23549217203785", "-0.0977383059477592", "2.02518965694603"], {9}: ["-0.447865693440633", "0.658574458861899", "-0.340521625885735", "0.537286110836878", "-1.30042171203745", "-0.236100070400754", "0.768003498073357", "0.0670380176656166"]))
# Lat/Long
text_4 = Text(Tree({0}: ["7457.080322", "4829.67749", "14.22304", "40.836387"], {1}: ["7638.810547", "4942.768066", "14.2251799999999", "40.837385"], {2}: ["8002.27002", "4942.768066", "14.22946", "40.837385"], {3}: ["8184.000488", "4829.67749", "14.2316", "40.836387"], {4}: ["8365.730469", "4490.407227", "14.23374", "40.833395"], {5}: ["8365.730469", "4716.587402", "14.23374", "40.83539"]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))
# Classification
text_5 = Text(flatten(Tree({0}: ["9"], {1}: ["9"], {2}: ["2"], {3}: ["2"], {4}: ["9"], {5}: ["2"]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)))
# 800m
# Data Set
text_6 = Text(Tree({0}: ["0.5", "0.6", "0.9", "0.95", "0.8", "1", "0.85"], {1}: ["0.6", "0.65", "0.95", "0.95", "0.8", "0.95", "0.85"], {2}: ["0.8", "0.7", "1", "0.95", "0.8", "0.9", "0.8"], {3}: ["0.85", "0.65", "1", "0.95", "0.8", "0.85", "0.8"], {4}: ["0.75", "0.5", "0.85", "0.95", "0.85", "0.9", "0.8"], {5}: ["0.9", "0.6", "0.95", "0.95", "0.8", "0.85", "0.8"]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))
# Centroids
text_7 = Text(Tree({0}: ["-0.776366525451621", "-0.996996627608822", "-1.24219705461033", "-0.237042757993216", "0.80152961021354", "-0.398037086437263", "0.883459224743138", "-0.819892052784442"], {1}: ["-0.166057782132203", "0.177519774191224", "0.134808510787606", "-0.237042757993216", "-0.873573850916945", "-0.345897749779022", "-1.39222759338943", "-0.384988921574952"], {2}: ["1.82498979271206", "1.43610064186483", "0.761647681231808", "-0.237042757993216", "0.715688173848214", "0.654672430408749", "-0.988333889117681", "1.59140393856476"], {3}: ["-0.623242362610461", "-0.538726382461105", "0.387224390631017", "-0.237042757993216", "-1.18411680231892", "-0.628972069374956", "0.476218437686582", "-0.535997396419455"], {4}: ["0.283247601611158", "0.179443875375036", "0.589578064987606", "4.21864818172871", "-0.909789945544142", "0.813715282697556", "0.323736548552773", "0.511056819058065"], {5}: ["-0.432583272562306", "-0.152784262363071", "0.393251300339939", "-0.237042757993216", "0.736074093981216", "-0.199756331728639", "0.598665074348201", "-0.161745141795267"], {6}: ["1.47073492187716", "1.46998401402455", "0.687295018597152", "-0.237042757993216", "-0.307614053130797", "-0.320995150960014", "0.54318901093885", "1.46040927915786"], {7}: ["-0.449398381036875", "-0.665274252335196", "-1.12781067535859", "-0.237042757993216", "-0.0402441284254929", "-0.570882715856948", "-1.00539258922745", "-0.893365924712283"], {8}: ["1.77719003295661", "1.46127193968657", "0.91490819111189", "4.21864818172871", "-0.035070660034354", "2.15390376220263", "0.0434127008477671", "1.93555865467306"], {9}: ["0.182937209968705", "0.511884916878823", "0.350201945276232", "-0.237042757993216", "0.58233064879448", "2.12827220897992", "0.107457888983084", "0.719347311776073"]))
# Lat/Long
text_8 = Text(Tree({0}: ["7457.080322", "4829.67749", "14.22304", "40.836387"], {1}: ["7638.810547", "4942.768066", "14.2251799999999", "40.837385"], {2}: ["8002.27002", "4942.768066", "14.22946", "40.837385"], {3}: ["8184.000488", "4829.67749", "14.2316", "40.836387"], {4}: ["8365.730469", "4490.407227", "14.23374", "40.833395"], {5}: ["8365.730469", "4716.587402", "14.23374", "40.83539"]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))

# ---- group: RH_IN:Radius
# Radius around the site to be considered
radius = Slider(2, range=0..2)

# ---- group: RH_IN:SelectAmenities
selectamenities = Slider(10, range=1..10)

# ---- group: RH_IN:AnalysisType
analysistype = Slider(0, range=0..6)

# ----
# Classification
text_9 = Text(flatten(Tree({0}: ["4"], {1}: ["4"], {2}: ["4"], {3}: ["4"], {4}: ["4"], {5}: ["4"]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)))

# ---- group: RH_IN:DisplayAnalysis
# Input
boolean = Boolean(True)

# ----
# 1200m
# Data Set
text_10 = Text(Tree({0}: ["1", "0.65", "0.85", "0.95", "0.8", "1", "0.95"], {1}: ["1", "0.7", "0.8", "0.95", "0.8", "1", "0.95"], {2}: ["1", "0.7", "0.8", "0.95", "0.75", "0.95", "0.95"], {3}: ["1", "0.7", "0.8", "0.9", "0.75", "0.95", "0.95"], {4}: ["1", "0.6", "0.85", "0.95", "0.85", "0.95", "0.95"], {5}: ["1", "0.7", "0.85", "0.9", "0.85", "0.95", "0.95"]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))
# Centroids
text_11 = Text(Tree({0}: ["-0.747611489137118", "-0.599125496799021", "-1.04186402657394", "-0.529339857382214", "0.511083585465842", "0.407214477850142", "-0.240784442382827", "-0.697782007161674"], {1}: ["1.26625652129867", "1.15065503461481", "-0.366539929764063", "-0.31243777377924", "0.612172015924172", "0.370995989525667", "-0.240784442382824", "1.15480786210031"], {2}: ["-0.533913761329282", "-0.64815520718727", "-0.210076825006853", "-0.598443830773374", "-1.16359712260017", "-1.21725364434609", "-0.240784442382825", "-1.00474348942237"], {3}: ["1.07530928083908", "0.733791045806976", "-0.601717087845349", "1.33511118251045", "0.140702103091025", "0.920134437277472", "4.15309224343521", "1.20031208170605"], {4}: ["0.963938262914133", "0.825347893260399", "0.786892643391551", "2.11772178269613", "-0.0848560668383866", "0.931151446213122", "-0.240784442382824", "1.29310393167578"], {5}: ["-0.288888030829095", "-0.122026554004298", "0.937957418479912", "-0.00275061165710509", "0.612320209778255", "-0.313027823751068", "-0.240784442382824", "-0.0731652383688966"], {6}: ["1.13527859019367", "0.197052992188675", "0.0634607075541534", "-0.603154842288476", "-1.44263765424743", "-0.455326317863261", "-0.240784442382825", "0.348133509944819"], {7}: ["-0.983742808711228", "-1.02559938397711", "0.711031310602936", "-0.445139041236404", "0.691469888606025", "-1.30047324184455", "-0.240784442382826", "-0.962622072611143"], {8}: ["-0.462349033632761", "-0.082905852752716", "-0.914924352956373", "-0.188105777699691", "-1.75902179070193", "0.697086137317433", "-0.240784442382825", "-0.511076006106718"], {9}: ["1.28099793395478", "1.90221781597387", "0.479171957640426", "0.0929531925383735", "-0.805371973010941", "0.88288797974211", "-0.240784442382825", "1.46356469782337"]))
# Lat/Long
text_12 = Text(Tree({0}: ["7457.080322", "4829.67749", "14.22304", "40.836387"], {1}: ["7638.810547", "4942.768066", "14.2251799999999", "40.837385"], {2}: ["8002.27002", "4942.768066", "14.22946", "40.837385"], {3}: ["8184.000488", "4829.67749", "14.2316", "40.836387"], {4}: ["8365.730469", "4490.407227", "14.23374", "40.833395"], {5}: ["8365.730469", "4716.587402", "14.23374", "40.83539"]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))

# ---- group: RH_IN:TextDisplay
boolean_2 = Boolean(False)

# ----
stream_filter = StreamFilter(Gate=radius, Stream0=text_3, Stream1=text_7, Stream2=text_11)
stream_filter_2 = StreamFilter(Gate=radius, Stream0=text_4, Stream1=text_8, Stream2=text_12)
stream_filter_3 = StreamFilter(Gate=radius, Stream0=text_2, Stream1=text_6, Stream2=text_10)
stream_filter_4 = StreamFilter(Gate=radius, Stream0=text, Stream1=text_5, Stream2=text_9)
series = Series(Start="1", Step=1, Count="2476")
series_2 = Series(Start=0, Step=1, Count="2475")
tree_branch = TreeBranch(Tree=stream_filter_2, Path=series, MaintainPaths=False)
tree_branch_2 = TreeBranch(Tree=stream_filter_3, Path=series, MaintainPaths=False)
list_item = ListItem(List=stream_filter_4, Index=series_2, Wrap=True)
cull_index = CullIndex(List=stream_filter, Indices="-1", Wrap=True)
panel = Panel(cull_index)
panel_2 = Panel(tree_branch_2)
panel_3 = Panel(list_item)
absolute = Absolute(Value=cull_index)

# ---- group: points
# The Point
point = Point(Point(120.9577492, 82.83359778, 0))

# ----
points = GetPoint(point, AtLeast=1, AtMost=5, Realtime=True)
number_slider = Slider(0.01, range=0.01..0.1)
entertainmentrate = Data(["entertainment_google", "3.50000000", "3.50000000", "3.50000000", "3.50000000", "3.50000000"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])
educationrate = Data(["education_google", "4.00000000", "4.00000000", "4.00000000", "4.00000000", "4.00000000"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])
shoppingrate = Data(["shopping_google", "4.20000000", "4.20000000", "4.20000000", "4.20000000", "4.20000000"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])
religionrate = Data(["religion_google", "4.30000000", "4.30000000", "4.30000000", "4.30000000", "4.30000000"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])
curve = Curve([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])
medicalrate = Data(["medical_google", "4.50000000", "4.50000000", "4.50000000", "4.50000000", "4.50000000"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])
publicrate = Data(["public_google", "4.40000000", "4.40000000", "4.40000000", "4.40000000", "4.40000000"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])
officerate = Data(["office_google", "3.50000000", "3.50000000", "3.50000000", "3.50000000", "3.50000000"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])
foodrate = Data(["food_google", "4.10000000", "4.10000000", "4.10000000", "4.10000000", "4.10000000"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])
number_slider_2 = Slider(7, range=0..100)
walkaveragedist1200 = Data(["walkD1200", "106.00000000", "105.00000000", "98.00000000", "95.00000000", "98.00000000"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])
walkaveragedist400 = Data(["walkD400", "108.00000000", "93.00000000", "86.00000000", "92.00000000", "133.00000000"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])
walkaveragedist800 = Data(["walkD800", "109.00000000", "103.00000000", "97.00000000", "104.00000000", "100.00000000"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])
attractivescore1200 = Data(["sum1200", "0.90000000", "0.90000000", "0.85000000", "0.85000000", "0.85000000"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])
# Connectivity
# Walkability
# Population Density
# Building Density
# Google Maps
# Sentimental
# Outdoor Comfort
text_13 = Text(["Connectivity", "Walkability", "Population Density", "Building Density", "Google Maps", "Sentimental", "Outdoor Comfort"])
attractivescore400 = Data(["sum400", "0.70000000", "0.70000000", "0.70000000", "0.75000000", "0.75000000"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])
attractivescore800 = Data(["sum800", "0.80000000", "0.80000000", "0.85000000", "0.85000000", "0.85000000"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])
popdense1200 = Data(["popD1200", "56535.00000000", "62287.00000000", "65456.00000000", "61919.00000000", "48228.00000000"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])
blddense1200 = Data(["bldD1200", "0.25000000", "0.25000000", "0.30000000", "0.30000000", "0.30000000"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])
popdense400 = Data(["popD400", "6454.00000000", "7521.00000000", "8184.00000000", "7891.00000000", "5753.00000000"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])
popdense800 = Data(["popD800", "26319.00000000", "29373.00000000", "30722.00000000", "28455.00000000", "19531.00000000"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])
blddense400 = Data(["bldD400", "0.35000000", "0.30000000", "0.25000000", "0.25000000", "0.15000000"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])
blddense800 = Data(["bldD800", "0.25000000", "0.25000000", "0.25000000", "0.25000000", "0.25000000"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])
scale = Scale(Geometry=curve, Center=Point(0, 0, 0), Factor=number_slider)  # -> Geometry, Transform
curve_2 = Curve(scale.Geometry)
area = Area(Geometry=curve_2)  # -> Area, Centroid
cp = ClosestPoint(Point=points, Cloud=area.Centroid)  # -> ClosestPoint, CPIndex, Distance
merge = Merge(
    Data1=graft(shoppingrate),
    Data2=graft(foodrate),
    Data3=graft(educationrate),
    Data4=graft(entertainmentrate),
    Data5=graft(religionrate),
    Data6=graft(officerate),
    Data7=graft(medicalrate),
    Data8=graft(publicrate))  # -> simplify(Result)
Z = UnitZ(Factor=Slider(2, range=0..10))
list_item_2 = ListItem(List=text_13, Index=analysistype, Wrap=True)
merge_2 = Merge(Data1=graft(attractivescore400), Data2=graft(attractivescore800), Data3=graft(attractivescore1200))  # -> simplify(Result)
merge_3 = Merge(Data1=graft(popdense400), Data2=graft(popdense800), Data3=graft(popdense1200))  # -> simplify(Result)
merge_4 = Merge(Data1=graft(blddense400), Data2=graft(blddense800), Data3=graft(blddense1200))  # -> simplify(Result)
merge_5 = Merge(Data1=graft(walkaveragedist400), Data2=graft(walkaveragedist800), Data3=graft(walkaveragedist1200))  # -> simplify(Result)
addition = Addition(A=cp.CPIndex, B="2")
move = Move(Geometry=cp.ClosestPoint, Motion=Z)  # -> Geometry, Transform
panel_4 = Panel(cp.CPIndex)
construct_domain = ConstructDomain(DomainStart=expr("-x", number_slider_2), DomainEnd=number_slider_2)
panel_5 = Panel("""400
800
1200""")
panel_6 = Panel("  //     ")
list_length = ListLength(List=scale.Geometry)
panel_7 = Panel("Analysis")
panel_8 = Panel("   ")
dots = DotDisplay(Point=move.Geometry, Colour=ColourSwatch(SwatchColor=RGB(255, 238, 0)), Size=Slider(73, range=0..100))
text_14 = Text("   ")
text_15 = Text("  //     ")
cir = Circle(Plane=cp.ClosestPoint, Radius=panel_5)
xz = XZPlane(Origin=move.Geometry)
text_16 = Text("Analysis")
flip = FlipMatrix(Data=merge)
panel_9 = Panel(flip)
flip_2 = FlipMatrix(Data=merge_2)
flip_3 = FlipMatrix(Data=merge_3)
flip_4 = FlipMatrix(Data=merge_4)
flip_5 = FlipMatrix(Data=merge_5)
panel_10 = Panel(list_length)
concatenate = Concatenate(Fragment_B=text_15, A=list_item_2, C=text_14, B=text_16)
cull_i = CullIndex(List=flip, Indices="0", Wrap=True)
text_17 = Text(tree_branch_2)
rectangle = Rectangle(Plane=xz, XSize=construct_domain, YSize=number_slider_2, Radius=0)  # -> Rectangle, Length
construct_point = ConstructPoint(XCoordinate=Slider(100, range=0..100), YCoordinate=0, ZCoordinate=0)
construct_point_2 = ConstructPoint(XCoordinate=Slider(91, range=0..100), YCoordinate=Slider(8, range=0..100), ZCoordinate=0)

# ---- group: Google Rate Amenity
item = ListItem(List=cull_i, Index=addition, Wrap=True)

# ----
panel_11 = Panel("""TOTAL AMENITY RATE :
 Shopping Rate : 
  Food Rate : 
  Education Rate : 
  Entertainment Rate : 
  Religion Rate : 
  Office Rate : 
  Medical Rate : 
  Public Rate : """)
panel_12 = Panel(text_17)
explode = Explode(Curve=rectangle.Rectangle, Recursive=True)  # -> Segments, Vertices

# ---- group: Attractive Score
item_2 = ListItem(List=flip_2, Index=addition, Wrap=True)

# ---- group: Population Density
item_3 = ListItem(List=flip_3, Index=addition, Wrap=True)

# ---- group: Building Density
item_4 = ListItem(List=flip_4, Index=addition, Wrap=True)

# ---- group: Walking Average Distance
item_5 = ListItem(List=flip_5, Index=addition, Wrap=True)

# ----
ma = MassAddition(Input=flatten(item))  # -> Result, PartialResults
panel_13 = Panel("Arial")
num = Number(item)
text_18 = Text("Arial")
merge_6 = Merge(Data1=ma.Result, Data2=flatten(num))  # -> graft(Result)
rectangle_2 = Rectangle(Plane=construct_point, XSize=Slider(20, range=0..100), YSize=Domain(-2, 2), Radius=0)  # -> Rectangle, Length

flatten_tree = FlattenTree(Tree=scale.Geometry, Path="{0}")
area_2 = Area(Geometry=flatten_tree)  # -> Area, Centroid
closest_point = ClosestPoint(Point=points, Cloud=area_2.Centroid)  # -> ClosestPoint, CPIndex, Distance
# Selected Mesh Display
surface = Surface(flatten_tree)
list_item_3 = ListItem(List=surface, Index=closest_point.CPIndex, Wrap=True)
mesh_colours = MeshColours(Mesh=list_item_3, Colours=ColourSwatch(SwatchColor=RGB(60, 0, 255)))

merge_7 = Merge(Data1=item_2, Data2=item_3, Data3=item_4, Data4=item_5)
# -- Analysis Title
c_script = CSharpScript(face=text_18, bold=Toggle(False), size=Slider(1.906, range=0..11), content=concatenate, pl=construct_point_2)  # -> out, A; inputs face: String, bold: Boolean, italics: Boolean, size: Double, content: String, pl: Plane
# ---------- c_script: C# usings ----------
using System.IO;
using System.Linq;
using System.Data;
using System.Drawing;
using System.Reflection;
using System.Windows.Forms;
using System.Xml;
using System.Xml.Linq;
using System.Runtime.InteropServices;

using Rhino.DocObjects;
using Rhino.Collections;
using GH_IO;
using GH_IO.Serialization;
# ---------- c_script: C# ----------
    if(size == 0)
      size = 1;

    if(!string.IsNullOrEmpty(face) && size > 0 && !string.IsNullOrEmpty(content) &&
      pl.IsValid)
    {
      using (var doc = Rhino.RhinoDoc.CreateHeadless(null))
      {
        var te = doc.Objects.AddText(content, pl, size, face, bold, italics);
        var txt = doc.Objects.Find(te) as Rhino.DocObjects.TextObject;

        if(txt != null)
        {
          var tt = txt.Geometry as Rhino.Geometry.TextEntity;
          A = tt.Explode();
        }
      }
    }
# ---------- end c_script ----------
concat = Concatenate(FragmentA=simplify(graft(panel_11)), FragmentB=merge_6)
deconstruct_brep = DeconstructBrep(Brep=rectangle_2.Rectangle)  # -> Faces, Edges, Vertices
item_6 = ListItem(List=explode.Segments, Index="1", Wrap=True)  # -> Item, Item1, Item2
branch = TreeBranch(Tree=merge_7, Path=radius, MaintainPaths=True)
panel_14 = Panel(concat)
ln = Line(StartPoint=move.Geometry, EndPoint=cp.ClosestPoint)
unit_y = UnitY(Factor=expr("-x", 1))
curve_3 = Curve(item_6.Item2)
list_item_4 = ListItem(List=deconstruct_brep.Edges, Index=0, Wrap=True)
panel_15 = Panel("""  Attractive Score :
  Average Population : 
  Average Building Density : 
  Average Walking porosity distance : """)
panel_16 = Panel("""  Range 400
  Range 800
  Range 1200""")
panel_17 = Panel(""" / 1
 people
 / 1
 m""")
move_2 = Move(Geometry=list_item_4, Motion=unit_y)  # -> Geometry, Transform
num_2 = Number(branch)
explode_2 = Explode(Curve=move_2.Geometry, Recursive=True)  # -> Segments, Vertices
branch_2 = TreeBranch(Tree=simplify(graft(panel_16)), Path=radius, MaintainPaths=True)
concat_2 = Concatenate(FragmentA=panel_15, FragmentB=num_2, FragmentC=panel_17)  # -> flatten(Result)
slider = Slider(1.422, range=0..11)
list_item_5 = ListItem(List=explode_2.Vertices, Index=0, Wrap=True)  # -> Item, Item1
text_19 = Text("Arial")
boolean_3 = Boolean(False)
number_slider_3 = Slider(26, range=0..100)
panel_18 = Panel("least")
panel_19 = Panel("most")
entwine = Entwine(Branch00=flatten(concat), Branch01=concat_2, Branch02=branch_2, FlattenInputs=True)  # -> simplify(graft(Result))
panel_20 = Panel(closest_point.CPIndex)
c_script_2 = CSharpScript(face=text_19, bold=boolean_3, size=slider, content="least", pl=list_item_5.Item)  # -> out, A; inputs face: String, bold: Boolean, italics: Boolean, size: Double, content: String, pl: Plane; same code as c_script
c_script_3 = CSharpScript(face=text_19, bold=boolean_3, size=slider, content="most", pl=list_item_5.Item1)  # -> out, A; inputs face: String, bold: Boolean, italics: Boolean, size: Double, content: String, pl: Plane; same code as c_script
text_20 = Text(closest_point.CPIndex)
curve_4 = Curve(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)
scale_2 = Scale(Geometry=curve_4, Center=Point(0, 0, 0), Factor=number_slider)  # -> Geometry, Transform
mesh_surface = MeshSurface(Surface=rectangle_2.Rectangle, UCount=number_slider_3, VCount=number_slider_3, Overhang=True, Equalize=False)
deconstruct_mesh = DeconstructMesh(Mesh=mesh_surface)  # -> Vertices, Faces, Colours, Normals
deconstruct = Deconstruct(Point=deconstruct_mesh.Vertices)  # -> XComponent, YComponent, ZComponent
bounds = Bounds(Numbers=deconstruct.XComponent)
text_21 = Text(["retail", "food", "education", "entertainment", "religion", "commercial", "healthcare", "public"])
deconstruct_domain = DeconstructDomain(Domain=bounds)  # -> Start, End
unit_z = UnitZ(Factor=expr("x", Slider(1, range=0..100)))
number_slider_4 = Slider(1, range=0..10)
panel_21 = Panel(text_21)
text_22 = Text("Arial")
area_3 = Area(Geometry=scale.Geometry)  # -> Area, Centroid
tree_branch_3 = TreeBranch(Tree=simplify(text_17), Path=closest_point.CPIndex, MaintainPaths=True)
gradient = Gradient(
    LowerLimit=deconstruct_domain.Start,
    UpperLimit=deconstruct_domain.End,
    Parameter=deconstruct.XComponent,
    stops=[0.15: RGBA(255, 255, 255, 0), 0.85: RGB(64, 64, 64)])
gradient_2 = Gradient(
    LowerLimit=deconstruct_domain.Start,
    UpperLimit=deconstruct_domain.End,
    Parameter=deconstruct.XComponent,
    stops=[0.303: RGBA(237, 237, 255, 0), 0.994: RGB(128, 128, 255)])
gradient_3 = Gradient(
    LowerLimit=deconstruct_domain.Start,
    UpperLimit=deconstruct_domain.End,
    Parameter=deconstruct.XComponent,
    stops=[0.679: RGBA(255, 232, 255, 0), 0.85: RGB(212, 0, 219)])
gradient_4 = Gradient(
    LowerLimit=deconstruct_domain.Start,
    UpperLimit=deconstruct_domain.End,
    Parameter=deconstruct.XComponent,
    stops=[0.637: RGBA(255, 233, 212, 0), 0.85: RGB(255, 128, 0)])
gradient_5 = Gradient(
    LowerLimit=deconstruct_domain.Start,
    UpperLimit=deconstruct_domain.End,
    Parameter=deconstruct.XComponent,
    stops=[0.346: RGBA(237, 237, 255, 0), 1: RGB(0, 128, 128)])
gradient_6 = Gradient(
    LowerLimit=deconstruct_domain.Start,
    UpperLimit=deconstruct_domain.End,
    Parameter=deconstruct.XComponent,
    stops=[0.663: RGBA(223, 228, 247, 0), 0.85: RGB(25, 25, 112)])
gradient_7 = Gradient(
    LowerLimit=deconstruct_domain.Start,
    UpperLimit=deconstruct_domain.End,
    Parameter=deconstruct.XComponent,
    stops=[0.15: RGBA(255, 255, 212, 0), 0.85: RGB(0, 128, 0)])
mass_addition = MassAddition(Input=tree_branch_3)  # -> Result, PartialResults
xy_plane = XYPlane(Origin=Point(0, 0, 0))
number = Number(expr("-x", Slider(1, range=0..10)))
series_3 = Series(Start=0, Step=Slider(5, range=0..10), Count=10)
entwine_2 = Entwine(
    Branch00=gradient,
    Branch01=gradient_2,
    Branch02=gradient_3,
    Branch03=gradient_4,
    Branch04=gradient_5,
    Branch05=gradient_6,
    Branch06=gradient_7,
    FlattenInputs=True)  # -> simplify(Result)
panel_22 = Panel(mass_addition.Result)
unit_z_2 = UnitZ(Factor=series_3)
move_3 = Move(Geometry=xy_plane, Motion=unit_z_2)  # -> Geometry, Transform
tree_branch_4 = TreeBranch(Tree=entwine_2, Path=analysistype, MaintainPaths=True)
series_4 = Series(Start=mass_addition.Result, Step="0.1", Count=selectamenities)
construct_mesh = ConstructMesh(Vertices=deconstruct_mesh.Vertices, Faces=deconstruct_mesh.Faces, Colours=tree_branch_4)
text_23 = Text(series_4)
series_5 = Series(Start=0, Step=1, Count=selectamenities)
swatch = ColourSwatch(SwatchColor=RGB(255, 255, 255))
mesh = Mesh(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)
unit_z_3 = UnitZ(Factor=Slider(0.1, range=0..0.1))
boolean_4 = Boolean(boolean)
merge_8 = Merge(Data1=c_script_2.A, Data2=c_script_3.A)
mesh_colours_2 = MeshColours(Mesh=mesh, Colours=ColourSwatch(SwatchColor=RGBA(165, 255, 255, 175)))
gate = StreamGate(Stream=c_script.A, Gate=boolean_4)  # -> Target0, Target1
move_4 = Move(Geometry=merge_8, Motion=unit_z_3)  # -> Geometry, Transform
number_2 = Number(100)
move_5 = Move(Geometry=construct_mesh, Motion=unit_z_3)  # -> flatten(Geometry), Transform
unit_z_4 = UnitZ(Factor=1)
merge_9 = Merge(Data1=gate.Target1)
panel_23 = Panel(number_2)

# ---- group: RH_OUT:Water
# Output
mesh_2 = Mesh(mesh_colours_2)

# ---- group: RH_OUT:Curves
# Analysis Title
curve_5 = Curve(merge_9)

# ---- group: RH_OUT:Least
# Gradient mesh
curve_6 = Curve(move_4.Geometry)

# ---- group: RH_OUT:SelectedMesh
# Selected Locality Coloured Blue
mesh_3 = Mesh(mesh_colours)

# ---- group: RH_OUTGradientLegend
rh_out_mesh = Mesh(move_5.Geometry)

# ----
boolean_toggle = BooleanToggle(False)
bool = Boolean(False)
text_24 = Text("Arial")
number_slider_5 = Slider(0.01, range=0..0.01)

# ----
# Analysis Display
# Connectivity
# Walkability
# Population Density
# Building Density
# Google Maps
# Sentimental
# Outdoor Comfort
list_item_6 = ListItem(List=tree_branch, Index=0, Wrap=True)  # -> Item, Item1
list_item_7 = ListItem(List=tree_branch_2, Index=analysistype, Wrap=True)
bounds_2 = Bounds(Numbers=flatten(list_item_7))
construct_point_3 = ConstructPoint(XCoordinate=list_item_6.Item, YCoordinate=list_item_6.Item1, ZCoordinate=0)
scale_3 = Scale(Geometry=construct_point_3, Center=Point(0, 0, 0), Factor=number_slider)  # -> Geometry, Transform
unit_z_5 = UnitZ(Factor=Slider(34, range=0..100))

remap_numbers = RemapNumbers(Value=flatten(list_item_7), Source=bounds_2, Target=Domain(0, 1))  # -> Mapped, Clipped
bounds_3 = Bounds(Numbers=flatten(remap_numbers.Mapped))
panel_25 = Panel(list_item_6.Item)

number_3 = Number(flatten(remap_numbers.Mapped))
deconstruct_domain_2 = DeconstructDomain(Domain=bounds_3)  # -> Start, End
unit_z_6 = UnitZ(Factor=graft(remap_numbers.Mapped))
gradient_8 = Gradient(
    LowerLimit=deconstruct_domain_2.Start,
    UpperLimit=deconstruct_domain_2.End,
    Parameter=number_3,
    stops=[0.15: RGBA(255, 255, 255, 0), 0.85: RGB(64, 64, 64)])
gradient_9 = Gradient(
    LowerLimit=deconstruct_domain_2.Start,
    UpperLimit=deconstruct_domain_2.End,
    Parameter=number_3,
    stops=[0.303: RGBA(237, 237, 255, 0), 0.994: RGB(128, 128, 255)])
gradient_10 = Gradient(
    LowerLimit=deconstruct_domain_2.Start,
    UpperLimit=deconstruct_domain_2.End,
    Parameter=number_3,
    stops=[0.679: RGBA(255, 232, 255, 0), 0.85: RGB(212, 0, 219)])
gradient_11 = Gradient(
    LowerLimit=deconstruct_domain_2.Start,
    UpperLimit=deconstruct_domain_2.End,
    Parameter=number_3,
    stops=[0.637: RGBA(255, 233, 212, 0), 0.85: RGB(255, 128, 0)])
gradient_12 = Gradient(
    LowerLimit=deconstruct_domain_2.Start,
    UpperLimit=deconstruct_domain_2.End,
    Parameter=number_3,
    stops=[0.207: RGB(0, 128, 128), 0.845: RGBA(237, 237, 255, 0)])
gradient_13 = Gradient(
    LowerLimit=deconstruct_domain_2.Start,
    UpperLimit=deconstruct_domain_2.End,
    Parameter=number_3,
    stops=[0.663: RGBA(223, 228, 247, 0), 0.85: RGB(25, 25, 112)])
gradient_14 = Gradient(
    LowerLimit=deconstruct_domain_2.Start,
    UpperLimit=deconstruct_domain_2.End,
    Parameter=number_3,
    stops=[0.15: RGBA(255, 255, 212, 0), 0.85: RGB(0, 128, 0)])
multiplication = Multiplication(A=unit_z_6, B=Slider(21, range=0..100))
entwine_3 = Entwine(
    Branch00=gradient_8,
    Branch01=gradient_9,
    Branch02=gradient_10,
    Branch03=gradient_11,
    Branch04=gradient_12,
    Branch05=gradient_13,
    Branch06=gradient_14,
    FlattenInputs=True)  # -> simplify(Result)
move_6 = Move(Geometry=scale_3.Geometry, Motion=multiplication)  # -> flatten(Geometry), Transform
delaunay_mesh = DelaunayMesh(Points=move_6.Geometry, Plane=PlaneXY(0, 0, 0))
tree_branch_5 = TreeBranch(Tree=entwine_3, Path=analysistype, MaintainPaths=True)
mesh_colours_3 = MeshColours(Mesh=delaunay_mesh, Colours=tree_branch_5)
area_4 = Area(Geometry=mesh_colours_3)  # -> Area, Centroid
project = Project(Geometry=area_4.Centroid, Plane=PlaneXY(0, 0, 0))  # -> Geometry, Transform
move_7 = Move(Geometry=project.Geometry, Motion=unit_z_5)  # -> Geometry, Transform
orient = Orient(Geometry=mesh_colours_3, Source=area_4.Centroid, Target=move_7.Geometry)  # -> Geometry, Transform

deconstruct_mesh_2 = DeconstructMesh(Mesh=mesh_colours_3)  # -> Vertices, Faces, Colours, Normals
face_normals = FaceNormals(Mesh=mesh_colours_3)  # -> Centers, Normals
project_2 = Project(Geometry=face_normals.Centers, Plane=PlaneXY(0, 0, 0))  # -> Geometry, Transform
point_in_curve = PointInCurve(Point=project_2.Geometry, Curve=scale_2.Geometry)  # -> Relationship, Point
dispatch = Dispatch(List=deconstruct_mesh_2.Faces, DispatchPattern=point_in_curve.Relationship)  # -> ListA, ListB
construct_mesh_2 = ConstructMesh(Vertices=deconstruct_mesh_2.Vertices, Faces=dispatch.ListA, Colours=deconstruct_mesh_2.Colours)
orient_2 = Orient(Geometry=construct_mesh_2, Source=area_4.Centroid, Target=move_7.Geometry)  # -> Geometry, Transform
# Connectivity
# Walkability
# Population Density
# Building Density
# Google Maps
# Sentimental
# Outdoor Comfort
mesh_plane = MeshPlane(Mesh=orient_2.Geometry, Plane=move_3.Geometry)
gate_2 = StreamGate(Stream=orient_2.Geometry, Gate=boolean)  # -> Target0, Target1
gate_3 = StreamGate(Stream=mesh_plane, Gate=boolean)  # -> Target0, Target1
# Attractivity of selected locality
merge_10 = Merge(Data1=gate_2.Target1)
merge_11 = Merge(Data1=gate_3.Target1)  # -> flatten(Result)

# ---- group: RH_OUT:Contours
# Classification Mesh
curve_7 = Curve(merge_11)

# ---- group: RH_OUT:AnalysisMesh
# Analysis fancy mesh
rh_out_mesh_2 = Mesh(merge_10)

# ----
number_4 = Number([400, 800, 1200])
panel_26 = Panel(number_4)
list_item_8 = ListItem(List=number_4, Index=radius, Wrap=True)
point_2 = Point(points)
surface_2 = Surface(Tree({0;0}: [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], {0;1}: [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], {0;2}: [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], {0;3}: [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], {0;4}: [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], {0;5}: [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], {0;6}: [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], {0;7}: [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]))
circle = Circle(Plane=point_2, Radius=list_item_8)
text_25 = Text(["retail", "food", "education", "entertainment", "religion", "commercial", "healthcare", "public"])
panel_27 = Panel(text_25)

scale_4 = Scale(Geometry=surface_2, Center=Point(0, 0, 0), Factor=number_slider)  # -> Geometry, Transform

# ----
# Sort Duplicate Values in native GH
list_indices = ListIndices(List=list_item)
series_6 = Series(Start=0, Step=1, Count=10)
create_set = CreateSet(List=series_6)  # -> Set, Map
equality = Equality(FirstNumber=graft(create_set.Set), SecondNumber=list_item)  # -> Equality, Inequality
bounds_4 = Bounds(Numbers=list_item)
dispatch_2 = Dispatch(List=list_indices, DispatchPattern=simplify(equality.Equality))  # -> ListA, ListB
mass_addition_2 = MassAddition(Input=simplify(absolute))  # -> Result, PartialResults
panel_28 = Panel(dispatch_2.ListA)
param_viewer = ParamViewer(mass_addition_2.Result)
# Classification Mesh in GH
range = Range(Domain=bounds_4, Steps=expr("x-1", 10))
deconstruct_domain_3 = DeconstructDomain(Domain=bounds_4)  # -> Start, End
list_item_9 = ListItem(List=scale.Geometry, Index=dispatch_2.ListA, Wrap=True)
gradient_15 = Gradient(
    LowerLimit=0,
    UpperLimit=deconstruct_domain_3.End,
    Parameter=range,
    stops=[0.15: RGB(255, 130, 160), 0.85: RGB(220, 0, 40)])
sort_list = SortList(Keys=flatten(mass_addition_2.Result), ValuesValuesA=simplify(param_viewer))  # -> Keys, ValuesValuesA
list_length_2 = ListLength(List=param_viewer)
surface_3 = Surface(list_item_9)
series_7 = Series(Start=0, Step=1, Count=list_length_2)
data_path = DataPath(series_7)
replace_paths = ReplacePaths(Data=surface_3, Search=sort_list.ValuesValuesA, Replace=data_path)
mesh_4 = Mesh(replace_paths)

text_26 = Text(dispatch_2.ListA)
gradient_16 = Gradient(
    LowerLimit=0,
    UpperLimit=deconstruct_domain_3.End,
    Parameter=range,
    stops=[0.15: RGB(201, 255, 234), 0.85: RGB(0, 153, 117)])
member_index = MemberIndex(Set=text_26, Member=text_20)  # -> simplify(Index), Count
clean_tree = CleanTree(RemoveNulls=True, RemoveInvalid=True, RemoveEmpty=invert(False), Tree=member_index.Index)  # -> simplify(Tree)
panel_30 = Panel(clean_tree)
tree_statistics = TreeStatistics(Tree=simplify(clean_tree))  # -> Paths, Length, Count

mesh_colours_4 = MeshColours(Mesh=mesh_4, Colours=graft(gradient_16))

panel_31 = Panel(tree_statistics.Paths)
tree_branch_6 = TreeBranch(Tree=simplify(surface_3), Path=tree_statistics.Paths, MaintainPaths=True)
area_5 = Area(Geometry=tree_branch_6)  # -> Area, Centroid
closest_point_2 = ClosestPoint(Point=area_5.Centroid, Cloud=area_3.Centroid)  # -> ClosestPoint, CPIndex, Distance
tree_branch_7 = TreeBranch(Tree=text_17, Path=closest_point_2.CPIndex, MaintainPaths=False)
list_item_10 = ListItem(List=scale.Geometry, Index=closest_point_2.CPIndex, Wrap=True)
mass_addition_3 = MassAddition(Input=tree_branch_7)  # -> flatten(Result), PartialResults
text_27 = Text(mass_addition_3.Result)
text_28 = Text(mass_addition_3.Result)
member_index_2 = MemberIndex(Set=text_27, Member=text_23)  # -> flatten(Index), Count
list_item_11 = ListItem(List=member_index_2.Index, Index=series_5, Wrap=True)
list_item_12 = ListItem(List=text_28, Index=list_item_11, Wrap=True)
list_item_13 = ListItem(List=list_item_10, Index=list_item_11, Wrap=True)
# Calculating similar atrractivity
subtraction = Subtraction(A=mass_addition.Result, B=list_item_12)
absolute_2 = Absolute(Value=subtraction)
area_6 = Area(Geometry=list_item_13)  # -> Area, Centroid
division = Division(A=absolute_2, B=mass_addition.Result)
closest_point_3 = ClosestPoint(Point=points, Cloud=area_6.Centroid)  # -> ClosestPoint, CPIndex, Distance
number_5 = Number(expr("x*100", division))
subtraction_2 = Subtraction(A=number_2, B=number_5)
cull_index_2 = CullIndex(List=list_item_13, Indices=closest_point_3.CPIndex, Wrap=True)

# ---- group: RH_OUT:ClassificationMesh
mesh_5 = Mesh(mesh_colours_4)

# ----
round_to_decimal_place = RoundToDecimalPlace(NumberX=subtraction_2, DecimalPlace=1, RoundType=0)  # -> Rounded, Difference
move_8 = Move(Geometry=area_6.Centroid, Motion=unit_z_4)  # -> Geometry, Transform
list_item_14 = ListItem(List=area_6.Centroid, Index=closest_point_3.CPIndex, Wrap=True)
mesh_colours_5 = MeshColours(Mesh=cull_index_2, Colours=ColourSwatch(SwatchColor=RGB(70, 191, 255)))

# ---- group: RH_OUT:SimilarMesh
mesh_6 = Mesh(mesh_colours_5)

# ----
panel_32 = Panel(round_to_decimal_place.Rounded)
line = Line(StartPoint=area_6.Centroid, EndPoint=list_item_14)
curve_middle = CurveMiddle(Curve=line)
list_length_3 = ListLength(List=curve_middle)
repeat_data = RepeatData(Data=list_item_14, Length=10)  # -> graft(Data)
point_3 = Point(graft(area_6.Centroid))
c_script_4 = CSharpScript(face=text_24, bold=bool, size=Slider(0.709, range=0..11), content=round_to_decimal_place.Rounded, pl=move_8.Geometry)  # -> out, A; inputs face: String, bold: Boolean, italics: Boolean, size: Double, content: String, pl: Plane; same code as c_script
c_script_5 = CSharpScript(crv=flatten(c_script_4.A), color=graft(swatch))  # -> out, A; inputs crv: Curve, color: Color
# ---------- c_script_5: C# ----------
    var c = color.R + "," + color.G + "," + color.B;
    crv.SetUserString("color", c);
    A = crv;
# ---------- end c_script_5 ----------

# ---- group: RH_OUT:FinalCurves
curve_8 = Curve(c_script_5.A)

# ----
random = Random(Range=Domain(0, 1), Number=list_length_3, Seed=2)
unit_z_7 = UnitZ(Factor=graft(random))
multiplication_2 = Multiplication(A=unit_z_7, B=Slider(6, range=0..10))
move_9 = Move(Geometry=graft(curve_middle), Motion=multiplication_2)  # -> graft(Geometry), Transform
merge_12 = Merge(Data1=simplify(point_3), Data2=simplify(move_9.Geometry), Data3=simplify(repeat_data))
interpolate = Interpolate(Vertices=merge_12, Degree=3, Periodic=False, KnotStyle=1)  # -> Curve, Length, Domain
c_script_6 = CSharpScript(crv=flatten(interpolate.Curve), color=graft(swatch))  # -> out, A; inputs crv: Curve, color: Color; same code as c_script_5

# ---- group: RH_OUT:Final
curve_9 = Curve(c_script_6.A)

# ----
area_7 = Area(Geometry=scale_4.Geometry)  # -> Area, Centroid
point_in_curve_2 = PointInCurve(Point=area_7.Centroid, Curve=circle)  # -> Relationship, Point
dispatch_3 = Dispatch(List=area_7.Centroid, DispatchPattern=point_in_curve_2.Relationship)  # -> ListA, ListB
point_4 = Point(dispatch_3.ListA)
line_2 = Line(StartPoint=point_2, EndPoint=point_4)  # -> simplify(Line)
list_length_4 = ListLength(List=simplify(line_2))
length = Length(Curve=line_2)
panel_33 = Panel(list_length_4)
clean_tree_2 = CleanTree(RemoveNulls=True, RemoveInvalid=True, RemoveEmpty=invert(False), Tree=length)  # -> simplify(Tree)
clean_tree_3 = CleanTree(RemoveNulls=True, RemoveInvalid=True, RemoveEmpty=invert(False), Tree=line_2)
bounds_5 = Bounds(Numbers=clean_tree_2)
# Amenity Graphs
panel_34 = Panel(clean_tree_2)
text_29 = Text(clean_tree_2)
deconstruct_domain_4 = DeconstructDomain(Domain=bounds_5)  # -> Start, End
panel_35 = Panel(deconstruct_domain_4.Start)
text_30 = Text(deconstruct_domain_4.Start)
member_index_3 = MemberIndex(Set=text_29, Member=text_30)  # -> simplify(Index), Count
list_item_15 = ListItem(List=simplify(clean_tree_3), Index=member_index_3.Index, Wrap=True)  # -> simplify(Item)
tree_statistics_2 = TreeStatistics(Tree=member_index_3.Index)  # -> simplify(Paths), Length, Count
panel_36 = Panel(member_index_3.Index)
end_points = EndPoints(Curve=list_item_15)  # -> Start, End
filtered_amenity_s_branches = Panel(tree_statistics_2.Paths)

sort_list_2 = SortList(Keys=flatten(list_length_4), ValuesValuesA=flatten(text_21))  # -> Keys, ValuesValuesA
list_item_16 = ListItem(List=sort_list_2.ValuesValuesA, Index=0, Wrap=True)
concat_3 = Concatenate(FragmentA="Suggested Program", FragmentB="   //   ", FragmentC=list_item_16)  # -> flatten(Result)
deconstruct_path = DeconstructPath(Branch=tree_statistics_2.Paths)  # -> flatten(Indices)
panel_37 = Panel(deconstruct_path)

cull_index_3 = CullIndex(List=text_25, Indices=deconstruct_path, Wrap=True)
list_item_17 = ListItem(List=text_25, Index=deconstruct_path, Wrap=True)
text_31 = Text(list_item_17)
text_32 = Text(cull_index_3)
concatenate_2 = Concatenate(FragmentA="//   ", FragmentB=text_31)
concatenate_3 = Concatenate(FragmentA="//   ", FragmentB=text_32)
merge_13 = Merge(Data1="Amenities Available", Data2=concatenate_2, Data4="Amenities Unavailable", Data5=concatenate_3)  # -> flatten(Result)

panel_38 = Panel(list_item_17)
panel_39 = Panel(cull_index_3)

get_string = GetString(entwine, AtLeast=1, AtMost=2147483647)
bool_2 = Boolean(True)

lng = ListLength(List=flatten(entwine))
divide = DivideCurve(Curve=curve_3, Count=expr("x-1", lng), Kinks=False)  # -> Points, Tangents, Parameters
xz_2 = XZPlane(Origin=divide.Points)
gate_4 = StreamGate(Stream=get_string, Gate=boolean_2)  # -> Target0, Target1
ln_2 = Line(StartPoint=divide.Points, EndPoint=move.Geometry)

list_item_18 = ListItem(List=divide.Points, Index=0, Wrap=True)
flip_plane = FlipPlane(Plane=xz_2, ReverseX=invert(False), ReverseY=invert(False), SwapAxes=invert(True))
move_10 = Move(Geometry=list_item_18, Motion=unit_z)  # -> Geometry, Transform
xz_3 = XZPlane(Origin=move_10.Geometry)
c_script_7 = CSharpScript(face=text_22, bold=bool_2, size=Slider(0.2, range=0..1), content=gate_4.Target0, pl=simplify(graft(flip_plane)))  # -> out, A; inputs face: String, bold: Boolean, italics: Boolean, size: Double, content: String, pl: Plane; same code as c_script
flip_plane_2 = FlipPlane(Plane=xz_3, ReverseX=invert(False), ReverseY=invert(False), SwapAxes=invert(True))

crv = Curve(flatten(c_script_7.A))

c_script_8 = CSharpScript(face=text_22, bold=bool_2, size=Slider(0.4, range=0..1), content=concat_3, pl=simplify(graft(flip_plane_2)))  # -> out, A; inputs face: String, bold: Boolean, italics: Boolean, size: Double, content: String, pl: Plane; same code as c_script
rectangle_3 = Rectangle(Plane=flip_plane_2, XSize=Slider(10, range=0..100), YSize=number, Radius=0)  # -> Rectangle, Length
rectangle_4 = Rectangle(Plane=flip_plane_2, XSize=Slider(6, range=0..10), YSize=Slider(8.5, range=0..10), Radius=0)  # -> Rectangle, Length
gate_5 = StreamGate(Stream=[ln_2, crv, ln, curve_3, c_script_8.A], Gate=boolean_2)  # -> Target0, Target1
c_script_9 = CSharpScript(crv=flatten(gate_5.Target0), color=graft(ColourSwatch(SwatchColor=RGB(255, 255, 255))))  # -> out, A; inputs crv: Curve, color: Color; same code as c_script_5
mesh_7 = Mesh(rectangle_3.Rectangle)
mesh_8 = Mesh(rectangle_4.Rectangle)
merge_14 = Merge(Data1=mesh_7, Data2=mesh_8)
mesh_colours_6 = MeshColours(Mesh=merge_14, Colours=ColourSwatch(SwatchColor=RGB(255, 255, 255)))
gate_6 = StreamGate(Stream=mesh_colours_6, Gate=boolean_2)  # -> Target0, Target1
merge_15 = Merge(Data1=gate_6.Target0)

# ---- group: RH_OUT:MeshBox
mesh_9 = Mesh(merge_15)

# ---- group: RH_OUT:AnalysisCurves
crv_2 = Curve(c_script_9.A)
